# Grasshopper definition UI.gh (Grasshopper 1.0.8)
# plug-ins: UiPlus

locator = CSharpScript(tar="Goal engine")  # -> out, id; inputs tar: String
# ---------- locator: C# ----------
// Grasshopper Script Instance
#region Usings
using System;
using System.Linq;
using System.Collections;
using System.Collections.Generic;
using System.Drawing;

using Rhino;
using Rhino.Geometry;

using Grasshopper;
using Grasshopper.Kernel;
using Grasshopper.Kernel.Data;
using Grasshopper.Kernel.Types;
#endregion

public class Script_Instance : GH_ScriptInstance
{
    #region Notes
    /* 
      Members:
        RhinoDoc RhinoDocument
        GH_Document GrasshopperDocument
        IGH_Component Component
        int Iteration

      Methods (Virtual & overridable):
        Print(string text)
        Print(string format, params object[] args)
        Reflect(object obj)
        Reflect(object obj, string method_name)
    */
    #endregion

    #region Members
    private readonly GH_Document GrasshopperDocument;
    #endregion

    private void RunScript(string tar, ref object id)
    {
        List<IGH_ActiveObject> comps = GrasshopperDocument.ActiveObjects();
        foreach (IGH_ActiveObject comp in comps){
            if(comp.NickName == tar){
                id = comp.InstanceGuid;
                break;
            }
        }

    }
}
# ---------- end locator ----------
program_host = Python3Script(reset=Button())  # -> out, host
# ---------- program_host: Python ----------
# requirements: requests
# requirements: numpy
import rhinoscriptsyntax as rs
import scriptcontext as sc
from Grasshopper import DataTree as DT
from Grasshopper.Kernel.Data import GH_Path
import Rhino
import Rhino.UI
import math
import requests
import numpy as np
import time
import Rhino.Geometry as rg

def pt2List(pt):

    if(isinstance(pt, Rhino.Geometry.Point3d)):
        return [pt.X, pt.Y, pt.Z]
    if(isinstance(pt, list)):
        return pt

def saveJSON(data, path):

    import json
    
    with open(path, 'w') as f:
        json.dump(data, f)

def loadJSON(path):

    import json

    with open(path) as f:
        data = json.load(f)
        return data

class Host(object):
    def __init__(self):
        self.sender = Sender(self)
        self.parser = Parser(self)
        self.editor = Editor(self)
        self.objectives = Objectives(self)
        self.solver = Solver(self)
        self.simulator = Simulator(self)
        self.modeler = Modeler(self)

        self.RTmode = False
        self.debug = False
        self.EPSILON = 1e-6
        self.sender.testServer()
        self.refireLock = False
        self.visScale = 1.

    def updateDesign(self, json):

        if(json is None):
            print("Error on server side")
            self.refireLock = True
        else:
            self.parser.parse(json)
            if("objectives" in json): self.objectives.loadJSON(json["objectives"])
            self.editor.push = True

    def sync(self, receive=True):

        if(receive):
            r = self.sender.pull()
        else:
            json = {}
            json["topology"] = self.parser.topoJSON()
            json["objectives"] = self.objectives.goalJSON()
            r = self.sender.push(json)
        
        self.updateDesign(r)

        return True

    def json(self):

        json = {}
        json["visScale"] = self.visScale
        json["sender"] = self.sender.json()
        json["parser"] = self.parser.json()
        json["editor"] = self.editor.json()
        json["objectives"] = self.objectives.json()

        return json

    def loadJSON(self, json):

        if("visScale" in json): self.visScale = json["visScale"]
        self.sender.loadJSON(json["sender"])
        self.parser.loadJSON(json["parser"])
        self.editor.loadJSON(json["editor"])
        self.objectives.loadJSON(json["objectives"])
        self.solver.flagRecompute()

        return self

    def save(self, fp):
        
        if(fp is None):
            return "invalid file path.", False
        
        json = self.json()

        timeStamp = time.asctime(time.localtime())
        json["time"] = timeStamp

        saveJSON(json, fp)

        message = "File saved to %s \non %s" % (fp, timeStamp)

        return message, False
    
    def load(self, fp):
        
        if(fp is None):
            return "invalid file path.", False
        
        json = loadJSON(fp)

        if("sender" in json): # design tool agent mode
            self.loadJSON(json)
        elif("edgeCenter" in json):
            self.updateDesign(json)

        # resync with manager
        self.sender.reset()
        sync = {}
        sync["topology"] = self.parser.topoJSON()
        sync["objectives"] = self.objectives.goalJSON()
        self.sender.push(sync)

        message = "Loaded file from %s" % fp
        if("time" in json):
            message += "\nFile was created on %s" % json["time"]

        return message, True

    def undo(self):

        r = self.sender.undo()
        self.updateDesign(r)
        
        self.solver.flagRecompute()

        return True
    
    def redo(self):

        r = self.sender.redo()
        self.updateDesign(r)

        self.solver.flagRecompute()

        return True

    def svDecompose(self, vecs):

        return ScrewVector.decompose(vecs)

class Sender(object):
    def __init__(self, host):
        self.host = host

        self.server = "http://127.0.0.1:5000"
        self.discRoute = "/discretize"
        self.topoUpdateRoute = "/topoUpdate"
        self.solveRoute = "/solve"
        self.pullRoute = "/pull"
        self.pushRoute = "/push"
        self.redoRoute = "/redo"
        self.undoRoute = "/undo"
        self.analyzeRoute = "/analyze"
        self.fixRoute = "/fix"
        self.resetRoute = "/reset"
        self.genIns = "/genModelingInstructions"
        self.jointUpdate = "/modeling"

        self.lastUrl = ""
        self.lastJSON = ""
    
    def json(self):

        json = {}
        json["lastUrl"] = self.lastUrl
        json["lastJSON"] = self.lastJSON

        return json
    
    def loadJSON(self, json):

        self.lastUrl = json["lastUrl"]
        self.lastJSON = json["lastJSON"]

        return self

    def post(self, url, args):

        if(self.host.debug):
            self.lastUrl = url
            self.lastJSON = args

        r = requests.post(url, json=args)

        return self._validate(r)

    def testServer(self):

        r = requests.get(self.server)

    def resend(self, printInfo=False):

        if(printInfo):
            print(self.lastUrl)
            print(self.lastJSON)
    
        self.post(self.lastUrl, self.lastJSON)

    def discretize(self, args):

        url = self.server + self.discRoute

        return self.post(url, args)
    
    def topoUpdate(self, args):

        url = self.server + self.topoUpdateRoute

        return self.post(url, args)

    def solveDesign(self, args):

        url = self.server + self.solveRoute

        return self.post(url, args)

    def analyzeDesign(self, args):

        url = self.server + self.analyzeRoute

        return self.post(url, args)

    def fixDesign(self, args):

        url = self.server + self.fixRoute

        return self.post(url, args)

    def genInstructions(self):

        url = self.server + self.genIns

        return self.post(url, {})
    
    def modelingUpdate(self, args):

        url = self.server + self.jointUpdate

        return self.post(url, args)

    def pull(self):

        url = self.server + self.pullRoute

        return self.post(url, {})
    
    def push(self, design):

        url = self.server + self.pushRoute

        return self.post(url, design)

    def reset(self):

        url = self.server + self.resetRoute

        r = requests.get(url)

    def undo(self):

        url = self.server + self.undoRoute

        return self.post(url, {})

    def redo(self):

        url = self.server + self.redoRoute

        return self.post(url, {})

    def _validate(self, r):

        if(r.status_code == 200):
            return r.json()
        else:
            return None

class Parser(object):
    def __init__(self, host=None):
        
        self.host = host if host is not None else self.host

        # topology
        self.nodes = [] # Point3d
        self.edges = [] # line
        self.edgePts = [] # Point3d
        self.edgeStart, self.edgeEnd = [], []
        self.adj = []
        self.nodesId = []
        self.nodesInfo = []
        self.edgesId = []
        self.edgesInfo = []
        
        # displacement
        self.axis = DT[Rhino.Geometry.Point3d]()
        self.rotMag = DT[float]()
        self.transMag = DT[float]()
        self.refPt = DT[Rhino.Geometry.Point3d]()
        
        # hidden
        self.nodeDisp = None
        self.edgeDisp = None
        
        # meta data
        self.isRigid = DT[bool]()
        self.scale = [0]
        self.ioIds = DT[int]()
        self.fixedIds = DT[int]()
        self.jointScrew = DT[str]()

        self.lastJSON = None
    
    def json(self):
        
        json = self.lastJSON

        return json
    
    def loadJSON(self, json):

        self.parse(json)

        return self
    
    def parse(self, topo):
        
        self.__init__()
        self.getNode(topo)
        self.getEdge(topo)
        self.getEdgeCenter(topo)
        self.getNodeEdgeInfo(topo)
        self.getDisp(topo)
        self.getRigidness(topo)
        self.getScale(topo)
        self.getStageTypes(topo)
        self.getJointScrew(topo)

        self.lastJSON = topo
    
    def getNode(self, topo):
        
        key = "nodeCoord"
        
        if(key not in topo): return
        
        for coord in topo[key]:
            pt = rs.CreatePoint(coord)
            self.nodes += [pt]
    
    def getEdge(self, topo):
        
        key = "edgePair"
        
        if(key not in topo): return

        self.adj = topo[key]
    
        for sId, eId in topo[key]:
            
            line = Rhino.Geometry.Line(self.nodes[sId], self.nodes[eId])
            self.edges += [line]
            self.edgeStart += [sId]
            self.edgeEnd += [eId]
    
    def getEdgeCenter(self, topo):
    
        key = "edgeCenter"
    
        if(key not in topo): return
    
        for coord in topo[key]:
            pt = rs.CreatePoint(coord)
            self.edgePts += [pt]
    
    def getNodeEdgeInfo(self, topo):
        
        spaces = int(math.ceil(math.log10(len(self.nodes))))
        for i in range(len(self.nodes)):
            numStr = ' ' * (spaces - len(str(i))) + str(i)
            self.nodesId += ["N %s" % numStr]
            self.nodesInfo += ["N %s" % numStr + ": " + str(topo["nodeCoord"][i])]
        
        if(len(self.edges) == 0): return

        spaces = int(math.ceil(math.log10(len(self.edges)))) + 1
        for i in range(len(self.edges)):
            numStr = ' ' * (spaces - len(str(i))) + str(i)
            self.edgesId += ["E %s" % numStr]
            self.edgesInfo += ["E %s" % numStr + ": " + str(topo["edgePair"][i])]
    
    def getDisp(self, topo):
        
        key = "displacement"
        
        if(key not in topo): return
        
        self.nodeDisp = np.asarray(topo[key])

        for i in range(len(topo[key])):
            mode = topo[key][i]
            path = GH_Path(i)
            for twist in mode:
                axis, rotMag, transMag, refPt = ScrewVector.decompose(twist)
                self.axis.Add(rs.CreatePoint(axis), path)
                self.rotMag.Add(rotMag, path)
                self.transMag.Add(transMag, path)
                self.refPt.Add(rs.CreatePoint(refPt), path)
    
    def getRigidness(self, topo):
        
        key = "isRigid"
        
        if(key not in topo): return
        
        for i in range(len(topo[key])):
            
            modeRigidness = topo[key][i]
            path = GH_Path(i)
            self.isRigid.AddRange(modeRigidness, path)
    
    def getScale(self, topo):
        
        key = "coordRange"
        
        if(key not in topo): return
        
        minCoord, maxCoord = topo[key]
        
        rangeX = maxCoord[0] - minCoord[0]
        rangeY = maxCoord[1] - minCoord[1]
        rangeZ = maxCoord[2] - minCoord[2]
        
        if(rangeX == 0): rangeX = float("inf")
        if(rangeY == 0): rangeY = float("inf")
        if(rangeZ == 0): rangeZ = float("inf")
    
    
        minRange = min(rangeX, rangeY, rangeZ)
        
        if(minRange == float("inf")): minRange = 1
        
        self.scale[0] = minRange * self.host.visScale
        
    def getStageTypes(self, topo):
        
        self.getIoIds(topo)
        self.getfixedIds(topo)
    
    def getIoIds(self, topo):
        
        key = "IOstageIds"
        
        if(key not in topo): return
        
        for i in range(len(topo[key])):
            
            ids = topo[key][i]
            path = GH_Path(i)
            self.ioIds.AddRange(ids, path)
    
    def getfixedIds(self, topo):
        
        key = "fixedIds"
        
        if(key not in topo): return
        
        for i in range(len(topo[key])):
            
            ids = topo[key][i]
            path = GH_Path(i)
            self.fixedIds.Add(ids, path)
        
    def getJointScrew(self, topo):

        key = "jointScrew"
        
        if(key not in topo): return
        
        self.edgeDisp = np.asarray(topo[key])

        for i in range(len(topo[key])):
            mode = topo[key][i]
            path = GH_Path(i)
            for twist in mode:
                self.jointScrew.Add(str(twist), path)

    def jointScrewInfo(self, eId, mId):

        twist = self.jointScrew.Branch(GH_Path(mId))[eId]
        twist = np.asarray(eval(twist))
        axisUnit, rotMag, transLen, refPt = ScrewVector.decompose(twist)

        axisUnit = rs.AddPoint(axisUnit)
        refPt = rs.AddPoint(refPt)

        return axisUnit, rotMag, transLen, refPt

    def topoJSON(self):

        json = {}
        json["nodes"] = [pt2List(node) for node in self.nodes]
        json["edges"] = self.adj

        return json

class Editor(object):
    def __init__(self, host):
        self.host = host
        self.push = False
        self.discretizer = Discretizer(self)
    
    def json(self):

        json = {}

        json["Discretizer"] = self.discretizer.json()

        return json
    
    def loadJSON(self, json):

        self.discretizer.loadJSON(json["Discretizer"])
        self.push = True

        return self

    def monitorTopo(self, nodes, edges):

        isChanged = self._checkTopoChange(nodes, edges)
        if(not isChanged): return False

        update = self._genTopoUpdate(nodes, edges)
        r = self.host.sender.topoUpdate(update)
        
        self.host.updateDesign(r)

        self.host.solver.flagRecompute()

        return True

    def _checkTopoChange(self, nodes, edges):
        
        if(len(nodes) == 1 and len(edges) <= 1): return False
        changed = False
        
        for i in range(len(nodes)):
            
            if(nodes[i] is None): changed = True; break
            if(nodes[i].DistanceTo(self.host.parser.nodes[i]) > self.host.EPSILON):
                changed = True; break
        
        if(changed): return changed

        for i in range(len(edges)):
            if(edges[i] is None): changed = True; break

        return changed
    
    def _genTopoUpdate(self, nodes, edges):

        update = {}
        
        nodesInfo = []
        nodesCull = []
        for i in range(len(nodes)):
            if(nodes[i] is None): 
                nodesInfo += [[0, 0, 0]]
                nodesCull += [i]
            else:
                nodesInfo += [[nodes[i].X, nodes[i].Y, nodes[i].Z]]

        edgesInfo = []
        print(len(edges))
        for i in range(len(edges)):
            if(edges[i] is not None):
                edgesInfo += [[self.host.parser.edgeStart[i], self.host.parser.edgeEnd[i]]]
        
        update["nodes"] = nodesInfo
        update["edges"] = edgesInfo
        update["nodesCull"] = nodesCull
        update["objectives"] = self.host.objectives.goalJSON()

        return update

    def trim(self, nodes, edges, mask):

        isChanged = not all(mask)

        if(not isChanged): return False

        nodes = [nodes[i] if mask[i]  else None for i in range(len(mask))]

        update = self._genTopoUpdate(nodes, edges)
        r = self.host.sender.topoUpdate(update)
        self.host.updateDesign(r)

        return True

    def addNode(self):

        prompt1 = "Select node point(s)"
        prompt2 = "Select more node point(s) or press Enter to complete"
        pts = rs.GetPoints(message1=prompt1, message2=prompt2)

        if(pts is None): return False

        nodes = self.host.parser.nodes + pts
        edges = [True] * len(self.host.parser.edges)

        update = self._genTopoUpdate(nodes, edges)
        r = self.host.sender.topoUpdate(update)
        print(update["nodes"])
        print(update["edges"])
        self.host.updateDesign(r)

        return True
    
    def addEdge(self):

        prompt1 = "Select first rigid stage"
        stage1 = rs.GetPoint(prompt1)

        if(stage1 is None): return False
        
        id1 = rs.PointArrayClosestPoint(self.host.parser.nodes, stage1)
        if(rs.Distance(stage1, self.host.parser.nodes[id1]) > self.host.EPSILON): return False

        prompt2 = "Select second rigid stage"
        stage2 = rs.GetPoint(prompt2)

        if(stage2 is None): return False

        id2 = rs.PointArrayClosestPoint(self.host.parser.nodes, stage2)
        if(rs.Distance(stage2, self.host.parser.nodes[id2]) > self.host.EPSILON): return False

        if(id1 > id2): id1, id2 = id2, id1
        
        nodes = self.host.parser.nodes
        edges = [True] * len(self.host.parser.edges)

        update = self._genTopoUpdate(nodes, edges)
        update["edges"] += [[id1, id2]]
        r = self.host.sender.topoUpdate(update)
        print(update["nodes"])
        print(update["edges"])
        self.host.updateDesign(r)

        return True

    def discretize(self, dBox, x, y, z, reset):
        
        refire = self.discretizer.discretize(dBox, x, y, z, reset)

        return refire

    def loadDiscretizer(self):

        dBox = []

        resX, resY, resZ = self.discretizer.prev["res"]

        return dBox, resX, resY, resZ

    @staticmethod
    def _addObjects(prompt="Select objects to add", objFilter=None):

        if(objFilter is None):
            objFilter = Rhino.DocObjects.ObjectType.AnyObject
        selObjects = Editor._getObjects(prompt, objFilter)
        
        # clean
        objects = []
        isValid = False
        for obj in selObjects:
            if(obj != None):
                objects += obj.ObjectId
                isValid = True

        return objects, isValid
    
    @staticmethod
    def _addObject(prompt="Select object to add", objFilter=None):
        
        if(objFilter is None):
            objFilter = Rhino.DocObjects.ObjectType.AnyObject
        selObject = Editor._getObjects(prompt, objFilter, single=True)
        
        if(selObject.ObjectId != None):
            isValid = True
            selObject = selObject.ObjectId
        else:
            isValid = False
            selObject = None
            
        return selObject, isValid

    @staticmethod
    def _getObjects(prompt, objFilter, single=False):
    
        sc.doc = Rhino.RhinoDoc.ActiveDoc
        if(single):
            result = Rhino.Input.RhinoGet.GetOneObject(prompt, False, objFilter)
        else:
            result = Rhino.Input.RhinoGet.GetMultipleObjects(prompt, False, objFilter)
        sc.doc = ghdoc
        
        return result[1]

class Discretizer(object):
    def __init__(self, editor):
        self.editor = editor
        self.prev = None
    
        self.cachedBox = None

    def json(self):

        json = {}

        json["prev"] = self.prev
        json["cachedBox"] = self.cachedBox.ToJSON(Rhino.FileIO.SerializationOptions()) if self.cachedBox is not None else None

        return json
    
    def loadJSON(self, json):

        self.prev = json["prev"]
        if("cachedBox" in json and json["cachedBox"] is not None):
            self.cachedBox = Rhino.Geometry.Brep.FromJSON(json["cachedBox"])
        #self._recreateBox()

        return self

    def discretize(self, domain, x, y, z, reset=False):
        
        update = self._genDiscretize(domain, x, y, z)
        if(update is None): return False
        isChanged = self._compare(update)
        
        refire = reset or (self.editor.host.RTmode and isChanged)
        if(not refire): return False
        
        updateClone = update.copy()
        r = self.editor.host.sender.discretize(update)
        self.editor.host.updateDesign(r)

        self.editor.host.solver.flagRecompute()
        self.prev = update
        
        return True

    def _compare(self, update):

        if(self.prev is None): return True

        if(rs.Distance(update['base'], self.prev['base']) > self.editor.host.EPSILON):
            return True
        if(rs.Distance(update['axes'][0], self.prev['axes'][0]) > self.editor.host.EPSILON):
            return True
        if(rs.Distance(update['axes'][1], self.prev['axes'][1]) > self.editor.host.EPSILON):
            return True
        if(rs.Distance(update['axes'][2], self.prev['axes'][2]) > self.editor.host.EPSILON):
            return True
        if(update["res"][0] != self.prev["res"][0]): return True
        if(update["res"][1] != self.prev["res"][1]): return True
        if(update["res"][2] != self.prev["res"][2]): return True
        
        return False

    def _genDiscretize(self, dBox, x, y, z):
        
        if(dBox is None): 
            if(self.cachedBox is None): return None # no dBox to work with, return
            else: dBox = self.cachedBox # use cahced box if available
        else:
            self.cachedBox = dBox # reset cached box if a new dBox is supplied
        
        vertices = dBox.Vertices
        if(vertices is None): return None
        corners = [v.Location for v in vertices]
        
        base = eval('[' + corners[0].ToString() + ']')

        vX = eval('[' + (corners[1] - corners[0]).ToString() + ']')
        vY = eval('[' + (corners[2] - corners[1]).ToString() + ']')
        vZ = eval('[' + (corners[4] - corners[1]).ToString() + ']')

        update = {"action":"discretize",
                  "diag": 0,
                  "base":base, 
                  "axes":[vX, vY, vZ], 
                  "res":[x, y, z]}
        
        return update

    def _recreateBox(self):
        
        info = self.prev

        ori = Rhino.Geometry.Point3d(*info["base"])
        x = Rhino.Geometry.Vector3d(*info["axes"][0])
        y = Rhino.Geometry.Vector3d(*info["axes"][1])
        z = Rhino.Geometry.Vector3d(*info["axes"][2])
        xRange = Rhino.Geometry.Interval(0, x.Length)
        yRange = Rhino.Geometry.Interval(0, y.Length)
        zRange = Rhino.Geometry.Interval(0, z.Length)

        x.Unitize()
        y.Unitize()
        plane = Rhino.Geometry.Plane(ori, x, y)

        if(plane.ZAxis * z < 0):
            zRange.Reverse()

        dBox = Rhino.Geometry.Box(plane, xRange, yRange, zRange)

        return dBox

class Objectives(object):
    def __init__(self, host):
        self.host = host
        
        self.count = 0
        self.modes = []

        self.constructor = []

    def json(self):

        json = {}

        json["count"] = self.count
        
        json["modes"] = [m.json() for m in self.modes]

        return json

    def loadJSON(self, json):

        self.count = json["count"]
        self.modes = [Mode.fromJSON(self, mJSON) for mJSON in json["modes"]]
        self.constructor = []

        return self

    def updateCount(self, count):

        if(count == self.count):return False
        
        if(count == 0 and self.count != 0): self.reset()

        if(count > self.count):
            for i in range(count - self.count):
                self.modes += [Mode(self)]
            self.count = len(self.modes)
        else:
            self.modes = self.modes[:count]
            self.count = len(self.modes)
        
        return True

    def reset(self):

        self.__init__(self.host)

        return True

    def parse(self, json):
        
        key = "objectives"
        if(key not in json): return

        self.count = len(json[key])
        self.modes = [Mode.fromJSON(json[key][i]) for i in range(self.count)]

    def deleteMode(self, flags):

        if(not any(flags)): return False

        index = flags.index(True)

        self.modes.pop(index)
        self.count = len(self.modes)

        return True

    def updateConfigId(self, configId):

        for i in range(self.count):
            self.modes[i].configId = configId[i]

    def updateFixedId(self, fixedId):

        for i in range(self.count):
            self.modes[i].groundId = fixedId[i]

    def selFixed(self, flags):

        if(not any(flags)): return []

        mId = flags.index(True)

        prompt = "Select fixed stage..."
        stage = rs.GetPoint(prompt)

        if(stage is None): return []

        fixedId = rs.PointArrayClosestPoint(self.host.parser.nodes, stage)
        if(rs.Distance(stage, self.host.parser.nodes[fixedId]) > self.host.EPSILON): return []

        self.modes[mId].groundId = fixedId

        return [m.groundId for m in self.modes]

    def addMotion(self, flags):
        
        if(any(flags)):
            mId = flags.index(True)
            self.constructor = PresConstructor(self, mId)
            
        return self.constructor

    def resetModePres(self, flags):
        
        if(any(flags)):
            mId = flags.index(True)
            self.modes[mId].pres = {}

    def preview(self, flags):

        if(flags[0] or not any(flags)):
            return [], [], [], [], []
        
        mId = flags.index(True) - 1

        return self.modes[mId].outputScrews()

    def goalJSON(self):
        
        json = {}

        json["count"] = self.count
        json["modes"] = [m.json() for m in self.modes]

        return json

class Mode(object):
    def __init__(self, obj=None):
        self.obj = obj

        self.groundId = 0
        self.configId = 0
        self.pres = {}
    
    def json(self):

        json = {}
        json["groundId"] = self.groundId
        json["configId"] = self.configId
        
        json["pres"] = [self.pres[sId].json() for sId in self.pres]

        return json
    
    def loadJSON(self, json):

        self.groundId = json["groundId"]
        self.configId = json["configId"]

        self.pres = {}
        for pJSON in json["pres"]:
            self.pres[pJSON["stageId"]] = Prescription.fromJSON(pJSON)
        
        return self

    def outputScrews(self):
        stageCen, axis, rotMag, transMag, refPt = [], [], [], [], []
        nodes = self.obj.host.parser.nodes
        
        # ground
        stageCen += [nodes[self.groundId]]
        axis += [rs.CreatePoint(0, 0, 0)]
        rotMag += [0]
        transMag += [0]
        refPt += [rs.CreatePoint(0, 0, 0)]
        # stages
        for sId in self.pres:
            if(sId == self.groundId): continue

            pres = self.pres[sId]
            vel = np.asarray(pres.vel)
            
            full = ScrewVector.fullSpace(pres.pivot).T
            twist = full @ vel
            
            components = ScrewVector.decompose(twist)

            stageCen += [nodes[sId]]
            axis += [rs.CreatePoint(components[0].tolist())]
            rotMag += [float(components[1])]
            transMag += [float(components[2])]
            refPt += [rs.CreatePoint(components[3].tolist())]

        return stageCen, axis, rotMag, transMag, refPt

    @staticmethod
    def fromJSON(obj, json):

        return Mode(obj).loadJSON(json)

class Prescription(object):
    def __init__(self, sId, kind, pivot, vel):
        self.stageId = sId # int
        self.kind = kind # "inp", "out"
        self.vel = vel if isinstance(vel, list) else vel.tolist() # list 
        self.pivot = pivot # Point3d
    
    def json(self):
        
        json = {}

        json["stageId"] = self.stageId
        json["kind"] = self.kind
        json["vel"] = self.vel
        json["pivot"] = pt2List(self.pivot)

        return json
    
    def loadJSON(self, json):

        self.stageId = json["stageId"]
        self.kind = json["kind"]
        self.vel = json["vel"]
        self.pivot = rs.CreatePoint(json["pivot"])
    
        return self

    @staticmethod
    def fromJSON(json):

        sId = json["stageId"]
        kind = json["kind"]
        center = rs.CreatePoint(json["pivot"])
        vel = json["vel"]

        return Prescription(sId, kind, center, vel)

class ScrewVector(object):
    SCREW_DIM = 6
    EUC_DIM = 3
    EPSILON = 1e-6
    
    @staticmethod
    def fullSpace(pivot):

        if(isinstance(pivot, Rhino.Geometry.Point3d)): pivot = [pivot.X, pivot.Y, pivot.Z]
        if(not isinstance(pivot, np.ndarray)): pivot = np.asarray(pivot)

        jft = np.identity(ScrewVector.SCREW_DIM)

        rotPos = np.cross(pivot, np.identity(ScrewVector.EUC_DIM))
        jft[:ScrewVector.EUC_DIM, ScrewVector.EUC_DIM:] = rotPos

        return jft

    @staticmethod
    def decompose(vec):

        # scheck for 0 screw vector
        vecNorm = np.linalg.norm(vec)
        if(vecNorm > ScrewVector.EPSILON): vecScaled = vec / vecNorm
        else: vecScaled = np.zeros(ScrewVector.SCREW_DIM)

        # mag analysis
        rotMag = np.linalg.norm(vec[:ScrewVector.EUC_DIM])
        transMag = np.linalg.norm(vec[ScrewVector.EUC_DIM:])

        if(rotMag > ScrewVector.EPSILON): # rotation
            vecUnitized = vec / rotMag
            axisUnit = vecUnitized[:ScrewVector.EUC_DIM]
            transLen = np.dot(axisUnit, vec[ScrewVector.EUC_DIM:])
            refPt = np.cross(axisUnit, vecUnitized[ScrewVector.EUC_DIM:])
        elif(transMag > ScrewVector.EPSILON): # pure translation
            vecUnitized = vec / transMag
            axisUnit, rotMag = vecUnitized[ScrewVector.EUC_DIM:], 0
            transLen = transMag
            refPt = np.zeros(ScrewVector.EUC_DIM)
        else: # all 0
            axisUnit = np.zeros(ScrewVector.EUC_DIM)
            rotMag = 0
            transLen = 0
            refPt = np.zeros(ScrewVector.EUC_DIM)
            
        return axisUnit, rotMag, transLen, refPt

class PresConstructor(object):
    def __init__(self, obj, mId):

        self.obj = obj
        self.modeId = mId
        self.stageIds = []
        self.vels = [0, 0, 0, 0, 0, 0]
        self.centers = []
        self.cenMode = 0
        self.cenOther = None
        self.kind = "inp"

    def _reCalCenters(self):

        if(self.cenMode == 0):
            self.centers = [rs.CreatePoint(0, 0, 0) for i in range(len(self.stageIds))]
        elif(self.cenMode == 1):
            self.centers = [self.obj.host.parser.nodes[i] for i in self.stageIds]
        elif(self.cenMode == 2):
            if(self.cenOther is not None):
                self.centers = [self.cenOther] * len(self.stageIds)
            else:
                self.centers = []
        return []
    
    def selCenMode(self, flags):

        mId = flags.index(True)

        if(mId != self.cenMode):
            self.cenMode = mId
            self._reCalCenters()
        
        return []

    def selCenter(self, flag):

        if(not flag): return []

        prompt = "Select pivot center point..."
        pt = rs.GetPoint(message=prompt)

        if(pt is None): return []

        self.cenOther = pt

        self._reCalCenters()

        return []

    def selNodes(self, flag):

        if(not flag): return []

        prompt1 = "Select node(s)..."
        prompt2 = "Select more node(s) or press Enter to complete..."
        pts = rs.GetPoints(message1=prompt1, message2=prompt2)

        if(pts is None): return []

        ids = []
        for pt in pts:
            nId = rs.PointArrayClosestPoint(self.obj.host.parser.nodes, pt)
            if(rs.Distance(pt, self.obj.host.parser.nodes[nId]) > self.obj.host.EPSILON): continue

            ids += [nId]
        
        self.stageIds = ids

        self._reCalCenters()

        return []

    def updateVel(self, vels):

        self.vels = vels
    
        return []

    def updateKind(self, flags):

        mId = flags.index(True)
        self.kind = "inp" if mId == 0 else "out"

        return []
    
    def _check(self):

        hasStages = len(self.stageIds) > 0
        hasCenters = len(self.centers) > 0
        equalLength = len(self.stageIds) == len(self.centers)

        return hasStages and hasCenters and equalLength

    def _dump(self):

        vel = np.asarray(self.vels)
        vel[:ScrewVector.EUC_DIM] *= np.pi / 180 # convert from degree to radian

        for i in range(len(self.stageIds)):
            sId = self.stageIds[i]
            pres = Prescription(sId, self.kind, self.centers[i], vel)
            self.obj.modes[self.modeId].pres[sId] = pres
        
        self.obj.constructor = []
        self.obj.host.solver.flagRecompute()

        sync = {}
        sync["topology"] = self.obj.host.parser.topoJSON()
        sync["objectives"] = self.obj.goalJSON()
        r = self.obj.host.sender.push(sync)
        
    def _getTwist(self, cen):

        a, b = rs.CreatePoint(0, 0, 0), rs.CreatePoint(0, 0, 0)

        # rx
        axis = rs.CreatePoint([1, 0, 0])
        ref = rs.VectorCrossProduct(cen, axis)

    def submit(self, flag):

        if(not flag): return "", False

        isValid = self._check()
        
        if(isValid):
            self._dump()
            return "\nMotion added!\nYou may now close this window.", True
        else:
            return "\nSpecification incomplete!\nPlease recheck input.", False
        
    def cancel(self, flag):
        
        if(not flag): return [], False

        self.obj.constructor = []

        return "Aborted! You may now close this window.", True

    def outputScrews(self):
        
        axis, rotMag, transMag, refPt = [], [], [], []
        
        if(len(self.stageIds) != len(self.centers)): 
            axis, rotMag, transMag, refPt

        vel = np.asarray(self.vels)
        vel[:ScrewVector.EUC_DIM] *= np.pi / 180

        for i in range(len(self.stageIds)):
            pivot = self.centers[i]
            full = ScrewVector.fullSpace(pivot).T
            twist = full @ vel
            components = ScrewVector.decompose(twist)
            axis += [rs.CreatePoint(components[0].tolist())]
            rotMag += [float(components[1])]
            transMag += [float(components[2])]
            refPt += [rs.CreatePoint(components[3].tolist())]
        
        return axis, rotMag, transMag, refPt

    def summarize(self):

        msg = []

        tarReady = len(self.stageIds) > 0
        if(tarReady):
            msg += ["Target stages: %s" % str(self.stageIds)]
        else:
            msg += ["Please specigy target stages..."]
        
        pivReady = not ((self.cenMode == 2) and\
                        (self.cenOther is None))
        if(pivReady):
            pivMsg = "Pivot point set"
            if(self.cenMode == 0): pivMsg += ": {0, 0, 0}"
            elif(self.cenMode == 1): pivMsg += ": stage center(s)"
            elif(self.cenMode == 2): pivMsg += ": {%.3f, %.3f, %.3f}" % (self.cenOther.X, self.cenOther.Y, self.cenOther.Z)
            msg += [pivMsg]
        else:
            msg += ["Please specify a pivot point..."]
        
        if(tarReady and pivReady):
            msg += ["Spec is ready to submit!"]
        else:
            msg += ["Spec is not ready yet..."]

        return '\n'.join(msg)

class Solver(object):
    
    codeColors = {-1: rs.CreateColor(128, 128, 128),
                0: rs.CreateColor(0, 255, 0),
                1: rs.CreateColor(255, 0, 0),
                2: rs.CreateColor(255, 255, 0)}
    
    def __init__(self, host=None):

        self.host = host
        self.maxIter = 10
        self.clone = True
        self.useCostvec = True
        self.status = {"valid": -1,
                       "simplification": -1,
                       "linear": -1,
                       "edgeCull": -1,
                       "decoupleX": -1,
                       "complete": -1}
        
        self.helper = []
    
    def reset(self):
        self.__init__(self.host)

    def flagRecompute(self):
        
        self.status = {"valid": -1,
                       "simplification": -1,
                       "linear": -1,
                       "edgeCull": -1,
                       "decoupleX": -1,
                       "complete": -1}
        
        self.helper = []

    def solve(self):

        json = {}
        json["topology"] = self.host.parser.topoJSON()
        json["objectives"] = self.host.objectives.goalJSON()
        json["config"] = self.configJSON()

        r = self.host.sender.solveDesign(json)
        self.host.updateDesign(r)

        self.status = r["status"]

        return True

    def fix(self, fix):

        # compose info
        r = self.host.sender.fixDesign(fix)
        self.host.updateDesign(r)

        self.status = r["status"]
        self.helper = []

        return True

    def analyze(self):
        
        json = {}
        json["topology"] = self.host.parser.topoJSON()
        json["objectives"] = self.host.objectives.goalJSON()

        r = self.host.sender.analyzeDesign(json)
        self.host.updateDesign(r)

        self.status = r["status"]

        return True

    def unpackStatus(self):
        
        names = ["simplification", "linear", "edgeCull", "decoupleX"]
        colors = [self.codeColors[host.solver.status[n]] for n in names]

        return names, colors

    def configJSON(self):
        
        config = {}
        config["clone"] = self.clone
        config["useCostvec"] = self.useCostvec
        config["maxIter"] = self.maxIter

        return config

    def getHelper(self, flags):

        if(not any(flags)): return self.helper
        
        hId = flags.index(True)
        
        if(hId == 0 and "simplificationInfo" in self.status):
            self.helper = HelperSimplification(self, self.status["simplificationInfo"])
        if(hId == 1 and "linearInfo" in self.status):
            self.helper = HelperLinear(self, self.status["linearInfo"])
        if(hId == 2 and "edgeCullInfo" in self.status):
            self.helper = HelperEdgeCull(self, self.status["edgeCullInfo"])
        if(hId == 3 and "decoupleXInfo" in self.status):
            self.helper = HelperDecoupleX(self, self.status["decoupleXInfo"])
        
        return self.helper

    def setIter(self, val):

        self.maxIter = val

    def genMessage(self):

        if(self.status["valid"] == -1 and self.status["complete"] == -1):
            msg = "Design is not cheked yet. \n\nPlease click 'Analyze' to get a summary of design suggestions. \n\nAlternatively, click 'Solve' to automate design iterations."
        elif(self.status["valid"] and self.status["complete"]):
            msg = "Design is complete. \n\nPlease proceed to flexure modeling."
        elif(self.status["valid"] and not self.status["complete"]):
            msg = "Design is incomplete. \n\nSee red-labeled heuristics to resolve transmission issues. \n\nOptional topology simplification opportunities are available."
        elif(not self.status["valid"]):
            msg = "Design problem is self-contradicting. \n\nCheck transmission prescriptions for inherently decoupled assignments or invalid assignments"
        
        return msg

class HeuristicsHelper(object):
    name = "Heuristics basic"
    
    baseColor = Rhino.Display.ColorHSV(0, 0, .5).ToArgbColor()
    pivsColor = Rhino.Display.ColorHSV(0, .3, .6).ToArgbColor()
    pickColor = Rhino.Display.ColorHSV(.4, .3, .8).ToArgbColor()

    def __init__(self, solver, info):
        self.solver = solver
        self.info = info
    
    def cancel(self):
        self.solver.helper = []
        del self

        return True

class HelperSimplification(HeuristicsHelper):
    name = "Topology simplification"
    dispatch = 0

    def __init__(self, solver, info):
        super().__init__(solver, info)

        self.assignmentCount = 0
        self.assignment = {}
        self.mergeEdges = []

        self.preserved = set()

        self.rawColors = []
        self.assignmentColors = []
        self._init()

    def _init(self):
        
        gCount = len(self.info["map"])
        colors = [Rhino.Display.ColorHSV(i / gCount, 1, 1).ToArgbColor() for i in range(gCount)]
        
        nodeColor = {}
        for gId in self.info["map"]:
            for nId in self.info["map"][gId]:
                nodeColor[nId] = colors[int(gId)]
        
        self.rawColors = [nodeColor[nId] for nId in sorted(nodeColor.keys())]
        self.assignmentColors = [self.baseColor]

    def assignGroup(self):

        # pick points

        prompt1 = "Select node(s)..."
        prompt2 = "Select more node(s) or press Enter to complete..."
        pts = rs.GetPoints(message1=prompt1, message2=prompt2)

        if(pts is None): return []

        ids = []
        for pt in pts:
            nId = rs.PointArrayClosestPoint(self.solver.host.parser.nodes, pt)
            if(rs.Distance(pt, self.solver.host.parser.nodes[nId]) > self.solver.host.EPSILON): continue

            ids += [nId]
        
        for nId in ids:
            self.assignment[nId] = self.assignmentCount
        
        self.assignmentCount += 1

        self._updateMergeEdges()

        return []
    
    def assignPreserve(self):

        # pick points

        prompt1 = "Select node(s)..."
        prompt2 = "Select more node(s) or press Enter to complete..."
        pts = rs.GetPoints(message1=prompt1, message2=prompt2)

        if(pts is None): return []

        ids = []
        for pt in pts:
            nId = rs.PointArrayClosestPoint(self.solver.host.parser.nodes, pt)
            if(rs.Distance(pt, self.solver.host.parser.nodes[nId]) > self.solver.host.EPSILON): continue

            ids += [nId]
        
        self.preserved.update(set(ids))
    
    def resetPreservation(self):

        self.preserved = set()

    def _updateMergeEdges(self):

        edges = []

        # find edges that land in the same group
        for eId in range(len(self.solver.host.parser.edges)):
            start = self.solver.host.parser.edgeStart[eId]
            end = self.solver.host.parser.edgeEnd[eId]
            
            if(start not in self.assignment or end not in self.assignment): continue

            startGroup = self.assignment[start]
            endGroup = self.assignment[end]

            if(startGroup == endGroup):
                edges += [self.solver.host.parser.edges[eId]]
        
        self.mergeEdges = edges

    def updateColors(self, groups, assignment):

        if(assignment): self.nodeColors = self.assignmentColors
        elif(groups): self.nodeColors = self.rawColors

    def resetAssignment(self):
        
        self.assignmentCount = 0
        self.assignment = {}
        self.mergeEdges = []

    def manualMerge(self):

        fix = {}
        fix["heuristics"] = "simplification"
        fix["mode"] = "manual"
        fix["groups"] = self.assignment

        return self.solver.fix(fix)
    
    def autoMerge(self):

        fix = {}
        fix["heuristics"] = "simplification"
        fix["mode"] = "semi"
        fix["preserved"] = list(self.preserved)

        return self.solver.fix(fix)
    
    def autoComplete(self):

        fix = {}
        fix["heuristics"] = "simplification"
        fix["mode"] = "auto"

        return self.solver.fix(fix)
    
class HelperLinear(HeuristicsHelper):
    name = "Linear edges removal"
    dispatch = 1

    def __init__(self, solver, info):
        super().__init__(solver, info)

        self.plucks = set()

        self._init()
        
        self.keep = None
        self.pivs = None
    
        self.nodeCount = None
        self.edgeCount = None

        self.nodeColors = []
        self.edgeColors = []

        self.rawNodeColors = []
        self.rawEdgeColors = []

        self._init()

    def _init(self):

        self.keep = set(self.info["keep"])
        self.pivs = set(self.info["pivs"])

        parser = self.solver.host.parser

        self.nodeCount = len(parser.nodes)
        self.rawNodeColors = []
        for i in range(self.nodeCount):
            color = self.baseColor if (i in self.keep) else self.pivsColor
            self.rawNodeColors += [color]

        self.edgeCount = len(parser.edges)
        self.rawEdgeColors = []
        for i in range(self.edgeCount):
            isNeighbor = parser.edgeStart[i] in self.pivs or parser.edgeEnd[i] in self.pivs
            color = self.pivsColor if isNeighbor else self.baseColor
            self.rawEdgeColors += [color]

    def reset(self):
        
        self.plucks = set()

    def pick(self):

        prompt1 = "Select node(s)..."
        prompt2 = "Select more node(s) or press Enter to complete..."
        pts = rs.GetPoints(message1=prompt1, message2=prompt2)

        if(pts is None): return []

        # filter
        ids = []
        for pt in pts:
            nId = rs.PointArrayClosestPoint(self.solver.host.parser.nodes, pt)
            if(rs.Distance(pt, self.solver.host.parser.nodes[nId]) > self.solver.host.EPSILON): continue

            if(nId not in self.pivs): continue

            ids += [nId]

        self.plucks.update(ids)
        
    def updateColors(self, hint, assignment):

        if(assignment):

            parser = self.solver.host.parser

            self.nodeColors = []
            for i in range(self.nodeCount):
                color = self.pickColor if (i in self.plucks) else self.rawNodeColors[i]
                self.nodeColors += [color]
            
            self.edgeColors = []
            for i in range(self.edgeCount):
                isNeighbor = parser.edgeStart[i] in self.plucks or parser.edgeEnd[i] in self.plucks
                color = self.pickColor if (isNeighbor) else self.rawEdgeColors[i]
                self.edgeColors += [color]

        elif(hint):
            self.nodeColors = self.rawNodeColors
            self.edgeColors = self.rawEdgeColors

    def manualPluck(self):

        fix = {}
        fix["heuristics"] = "linear"
        fix["mode"] = "manual"
        fix["pluck"] = list(self.plucks)

        return self.solver.fix(fix)
    
    def autoComplete(self):

        fix = {}
        fix["heuristics"] = "linear"
        fix["mode"] = "auto"

        return self.solver.fix(fix)

class HelperEdgeCull(HeuristicsHelper):
    name = "Redundant edge culling"
    dispatch = 2

    def __init__(self, solver, info):
        super().__init__(solver, info)

        self.plucks = set()

        self.keep = None
        self.pivs = None

        self.nodeCount = None
        self.edgeCount = None

        self.nodeColors = []
        self.edgeColors = []

        self.rawNodeColors = []
        self.rawEdgeColors = []

        self._init()
    
    def _init(self):

        self.keep = set(self.info["keep"])
        self.pivs = set(self.info["pivs"])

        parser = self.solver.host.parser

        self.rawNodeColors = [self.baseColor] * len(parser.nodes)
        self.nodeColors = self.rawNodeColors

        self.rawEdgeColors = []
        for i in range(len(parser.edges)):
            color = self.baseColor if (i in self.keep) else self.pivsColor
            self.rawEdgeColors += [color]
        
    def reset(self):
        
        self.plucks = set()

    def pick(self):
        
        parser = self.solver.host.parser
        EPS = self.solver.host.EPSILON

        # pick point 1
        prompt1 = "Select first rigid stage"
        stage1 = rs.GetPoint(prompt1)

        if(stage1 is None): return False
        
        id1 = rs.PointArrayClosestPoint(parser.nodes, stage1)
        if(rs.Distance(stage1, parser.nodes[id1]) > EPS): return False

        # pick point 2
        prompt2 = "Select second rigid stage"
        stage2 = rs.GetPoint(prompt2)

        if(stage2 is None): return False

        id2 = rs.PointArrayClosestPoint(parser.nodes, stage2)
        if(rs.Distance(stage2, parser.nodes[id2]) > EPS): return False

        if(id1 > id2): id1, id2 = id2, id1
        
        # find edge id
        target = None
        for eId in range(len(parser.edges)):
            eS = parser.edgeStart[eId]
            eE = parser.edgeEnd[eId]

            if((eS == id1 and eE == id2) or (eS == id2 and eE == id1)):
                target = eId
                break
        
        if(target is None): return

        if(target in self.pivs): self.plucks.add(target)

    def updateColors(self, hint, assignment):

        if(assignment):

            parser = self.solver.host.parser

            self.edgeColors = []
            for i in range(len(parser.edges)):
                color = self.pickColor if (i in self.plucks) else self.rawEdgeColors[i]
                self.edgeColors += [color]
            
        elif(hint):
            self.edgeColors = self.rawEdgeColors

    def manualPluck(self):

        fix = {}
        fix["heuristics"] = "edgeCull"
        fix["mode"] = "manual"
        fix["pluck"] = list(self.plucks)

        return self.solver.fix(fix)
    
    def autoComplete(self):

        fix = {}
        fix["heuristics"] = "edgeCull"
        fix["mode"] = "auto"

        return self.solver.fix(fix)

class HelperDecoupleX(HeuristicsHelper):
    name = "Cross-modal decoupling fixer"
    dispatch = 3
    heuristics = [None, "buildCost", "orthoFirst", "rotationFirst", "translationFirst",  "zFirst"]

    def __init__(self, solver, info):
        super().__init__(solver, info)

        self.edges = set()
        self.nodes = []
        
        self.nodeColors = []
        self.edgeColors = []

        self.rawNodeColors = []
        self.rawEdgeColors = []

        self._biasConstructors = []
        self.biasLabels = []
        self.biases = []
        
        self.constructor = []

        self._init()

    def _init(self):

        parser = self.solver.host.parser

        for key in self.info["edges"]: self.edges.update(self.info["edges"][key])
        self.nodes = set(self.info["nodes"])

        self.rawNodeColors = []
        for i in range(len(parser.nodes)):
            color = self.pivsColor if i in self.nodes else self.baseColor
            self.rawNodeColors += [color]
        
        self.rawEdgeColors = []
        for i in range(len(parser.edges)):
            color = self.pivsColor if i in self.edges else self.baseColor
            self.rawEdgeColors += [color]

        # biases
        self._biasConstructors = [BiasConstructor(self, info) for info in self.info["suggestions"]]
        self.biasLabels = [c.label for c in self._biasConstructors]
        self.biases = [None] * len(self._biasConstructors)

    def setBias(self, flags):

        index = flags.index(True)
        self.constructor = self._biasConstructors[index]
    
    def updateBiases(self):

        self.biases = []
        for cons in self._biasConstructors:
            if(cons.setTwist is None):
                self.biases += ["Unassigned"]
            else:
                self.biases += ["Assignment: " + str(cons.setTwist)]

    def clearBias(self, flags):

        index = flags.index(True)

        self._biasConstructors[index].setTwist = None
        self.updateBiases()

    def updateColors(self, hint, assignment):

        if(assignment):
            self.nodeColors = self.rawNodeColors
            self.edgeColors = self.rawEdgeColors
            
        elif(hint):
            self.nodeColors = self.rawNodeColors
            self.edgeColors = self.rawEdgeColors

    def manual(self, h1Id, h2Id, magMul):

        fix = {}
        fix["heuristics"] = "decoupleX"
        fix["mode"] = "manual"

        order = []
        if(h1Id != 0): order += [self.heuristics[h1Id]]
        if(h2Id != 0 and (h1Id != 0 and h2Id != h1Id)): order += [self.heuristics[h2Id]]
        fix["order"] = order
        fix["magMul"] = magMul

        assignments = []
        for bias in self._biasConstructors:
            assignments += [bias.outputJSON()]
        fix["assignments"] = assignments

        return self.solver.fix(fix)

    def semiAuto(self, h1Id, h2Id, magMul):

        fix = {}
        fix["heuristics"] = "decoupleX"
        fix["mode"] = "semi"

        order = []
        if(h1Id != 0): order += [self.heuristics[h1Id]]
        if(h2Id != 0 and (h1Id != 0 and h2Id != h1Id)): order += [self.heuristics[h2Id]]
        fix["order"] = order
        fix["magMul"] = magMul

        return self.solver.fix(fix)

    def autoComplete(self):

        fix = {}
        fix["heuristics"] = "decoupleX"
        fix["mode"] = "auto"

        return self.solver.fix(fix)

class BiasConstructor(object):
    def __init__(self, helper, info):

        self.helper = helper
        self.cId = info["configId"]
        self.mId = info["modeId"]
        self.nId = info["nodeId"] if "nodeId" in info else None
        self.eId = info["edgeId"] if "edgeId" in info else None
        self.avaTwists = np.asarray(info["avaTwists"])
        self.cand = np.asarray(info["cand"])
        self.mag = info["mag"]

        self.setTwist = None
        self._wipTwist = None

        self.center = None
        if(self.eId is None): self.center = self.helper.solver.host.parser.nodes[self.nId]
        else: self.center = self.helper.solver.host.parser.edgePts[self.eId]

        self.label = "Configuration: %d, Mode: %d" % (self.cId, self.mId)
        target = ", Node: %d" % self.nId if (self.eId is None) else ", Edge: %d" % self.eId
        self.label += target
    
    def update(self, mode, pickId, mag, twist):

        if(mode[0]): self._wipTwist = self.avaTwists[pickId] * mag
        elif(mode[1]): self._wipTwist = np.asarray(twist)

    def assign(self):
        
        self.setTwist = self._wipTwist
        self.helper.constructor = []
        self.helper.updateBiases()

        return True
        
    def cancel(self):

        self._wipTwist = None
        self.helper.constructor = []
        self.helper.updateBiases()

        return True

    def outputJSON(self):

        info = {}
        info["configId"] = self.cId
        info["modeId"] = self.mId
        if(self.eId is None): info["nodeId"] = self.nId
        else: info["edgeId"] = self.eId
        info["pick"] = self.setTwist if self.setTwist is None else self.setTwist.tolist()

        return info

    def outputScrew(self):

        if(self._wipTwist is None): return [], [], [], [], []
        
        axis, rotMag, transMag, refPt = ScrewVector.decompose(self._wipTwist)

        axis = rs.CreatePoint(axis.tolist())
        refPt = rs.CreatePoint(refPt.tolist())
        
        return self.center, axis, rotMag, transMag, refPt

class Simulator(object):
    def __init__(self, host):
        self.host = host
    
    def simulate(self, view, act):

        axis, rotMag, transMag, refPt = [], [], [], []

        if(view[0] or True not in view): return axis, rotMag, transMag, refPt

        cView = np.asarray(view[1:], dtype=float)
        mask = cView[[m.configId for m in self.host.objectives.modes]]

        act = np.asarray(act)

        val = mask * act
        val = val.reshape(self.host.objectives.count, 1, 1)

        factored = self.host.parser.nodeDisp * val
        twists = np.sum(factored, axis=0)

        for twist in twists:
            ax, rM, tM, pt = ScrewVector.decompose(twist)
            axis += [rs.CreatePoint(ax)]
            rotMag += [rM]
            transMag += [tM]
            refPt += [rs.CreatePoint(pt)]
        
        return axis, rotMag, transMag, refPt

class Modeler(object):
    def __init__(self, host):
        self.host = host
        self.joints = []
        self.initialized = False

        self.editing = []
    
    def initJoints(self):

        for i in range(len(self.host.parser.edges)):
            self.joints += [Joint(self, i)]

        info = self.host.sender.genInstructions()

        if(info is None): return

        for inf in info:
            i = inf["id"]
            self.joints[i].updateInfo(inf)

        self.initialized = True

    def json(self):

        info = {}
        info["joints"] = [j.json() for j in self.joints]

    def labels(self):

        names = []
        for i in range(len(self.joints)):
            names += ["Joint %d" % i]

        edit = ["Edit"] * len(self.joints)
        reset = ["Reset"] * len(self.joints)
        status = [j.status for j in self.joints]

        return names, edit, reset, status

    def edit(self, flags):

        if(True not in flags): return
        jId = flags.index(True)

        self.editing = self.joints[jId]
    
    def reset(self, flags):

        if(True not in flags): return
        jId = flags.index(True)

        self.joints[jId].reset()

class Joint(object):
    def __init__(self, modeler, id=None):

        # native properties
        self.modeler = modeler
        self.id = id
        self.flexures = []
        self.flexureCount = 0
        self.status = "Null" # Complete, Incomplete

        # analytic
        self.message = ""
        self.spaces = None
        self.bases = None
        self.center = None
        self.OC = None
        self.freedoms = None
    
    def reset(self):

        self.flexures = []
        self.flexureCount = 0
        self.status = "Null"

        self._step()
    
    @staticmethod
    def _isCoplanar(pts, tolerance=1e-6):
        if len(pts) != 4:
            return False
        plane = rg.Plane(pts[0], pts[1], pts[2])

        return plane.DistanceTo(pts[3]) <= tolerance
    
    def _selectBlade(self):
            
        # Ask user for mode
        choice = rs.GetString("Select input type", "Surface", ["Surface", "Points"])
        
        if choice == "Surface":
            go = Rhino.Input.Custom.GetObject()
            go.SetCommandPrompt("Select a surface")
            go.GeometryFilter = Rhino.DocObjects.ObjectType.Surface
            go.SubObjectSelect = False
            if go.Get() != Rhino.Input.GetResult.Object:
                return "Cancelled", None
            surf_ref = go.Object(0)
            surf = surf_ref.Surface()
            
            # Get domain and evaluate corners
            udom = surf.Domain(0)
            vdom = surf.Domain(1)
            pts = [
                surf.PointAt(udom.T0, vdom.T0),
                surf.PointAt(udom.T1, vdom.T0),
                surf.PointAt(udom.T1, vdom.T1),
                surf.PointAt(udom.T0, vdom.T1)
            ]
        
        elif choice == "Points":
            gp = Rhino.Input.Custom.GetObject()
            gp.SetCommandPrompt("Select 4 points (one by one)")
            gp.GeometryFilter = Rhino.DocObjects.ObjectType.Point
            gp.EnablePreSelect(False, True)
            pts = []
            while len(pts) < 4:
                res = gp.Get()
                if res != Rhino.Input.GetResult.Object:
                    return "Cancelled", None
                obj_ref = gp.Object(0)
                pt = obj_ref.Point().Location
                pts.append(pt)
        
        if(Joint._isCoplanar(pts)):
            return "Success", pts
        else:
            RhinoApp = Rhino.RhinoApp

            # Message in command line
            RhinoApp.WriteLine("⚠ Warning: Your points are not co-planar.")

            # Popup warning window
            Rhino.UI.Dialogs.ShowMessage("Your points are not co-planar.\nPlease check the input.", "Warning")
            return "Points are not co-plannar", None
    
    def _selectRod(self):
        choice = rs.GetString("Define line by", "Line", ["Line", "Points"])
        
        if choice == "Line":
            go = Rhino.Input.Custom.GetObject()
            go.SetCommandPrompt("Select a line curve")
            go.GeometryFilter = Rhino.DocObjects.ObjectType.Curve
            go.SubObjectSelect = False

            if go.Get() != Rhino.Input.GetResult.Object:
                return "No line selected.", None
            
            curve = go.Object(0).Curve()

            if not curve.IsLinear():
                return "Selected curve is not a straight line.", None
            
            pt1, pt2 = curve.PointAtStart, curve.PointAtEnd
        
        elif choice == "Points":
            gp = Rhino.Input.Custom.GetPoint()
            gp.SetCommandPrompt("Pick first point")
            if gp.Get() != Rhino.Input.GetResult.Point:
                return "Cancelled.", None
            pt1 = gp.Point()

            gp.SetCommandPrompt("Pick second point")
            if gp.Get() != Rhino.Input.GetResult.Point:
                return "Cancelled.", None
            pt2 = gp.Point()

        else:
            return "Invalid input type.", None
        
        return "Success", (pt1, pt2)

    def updateInfo(self, info):
        print(info)
        if("id" in info): self.id = info["id"]
        if("message" in info): self.message = info["message"]
        if("spaces" in info): self.spaces = info["spaces"]
        if("bases" in info): self.bases = info["bases"]
        if("center" in info): self.center = info["center"]
        if("OC" in info): self.OC = info["OC"]
        if("freedoms" in info): self.freedoms = info["freedoms"]

    def addBlade(self):

        msg, pts = self._selectBlade()

        if(pts is None): print(msg); return
             
        flx = Blade(pts)
        self.addFlexure(flx)

        self._step()
    
    def addRod(self):

        msg, pts = self._selectRod()

        if(pts is None): print(msg); return
             
        flx = Rod(pts)
        self.addFlexure(flx)

        self._step()
    
    def addFlexure(self, flexure):

        for i in range(len(self.flexures)):
            self.flexures[i].id = i
        
        flexure.id = len(self.flexures)

        self.flexures += [flexure]
        self.flexureCount = len(self.flexures)
    
    def json(self):

        info = {}

        info["id"] = self.id
        info["flexures"] = [f.json() for f in self.flexures]
        info["center"] = self.center
        info["freedoms"] = self.freedoms

        return info

    def _step(self):

        info = self.json()
        update = self.modeler.host.sender.modelingUpdate(info)
        self.updateInfo(update)

    @staticmethod
    def fromJSON(info):
        
        joint = Joint()
        joint.updateInfo(info)

        return joint

class Blade(object):
    def __init__(self, pts, id=None):
        
        self.id = id
        self.normal = None
        self.center = None
        self.pts = pts

        self.geo = None

        self._init(pts)
        
    def _init(self, pts):

        srf = rs.AddSrfPt(pts)
        self.geo = srf

        # Get surface center and normal
        self.center = rs.SurfaceAreaCentroid(srf)[0]
        self.normal = rs.SurfaceNormal(srf, rs.SurfaceAreaCentroid(srf)[0])
    
    def json(self):

        info = {}
        
        info["type"] = "blade"
        info["id"] = self.id
        info["normal"] = list(self.normal)
        info["center"] = list(self.center)
        info["pts"] = [list(pt) for pt in self.pts]

        return info

    def outputVis(self):
        return [rs.AddSrfPt(self.pts)]

class Rod(object):
    def __init__(self, pts, id=None):
        
        sPt, ePt = pts

        self.id = id
        self.start = sPt
        self.end = ePt

        self.geo = None

        self._init()

    def _init(self):

        self.geo = rs.AddLine(self.start, self.end)
        
    def json(self):

        info = {}
        info["type"] = "rod"
        info["id"] = self.id
        info["start"] = list(self.start)
        info["end"] = list(self.end)

        return info

    def outputVis(self):
        line = rs.AddLine(self.start, self.end)
        pipe = rs.AddPipe(line, [0, 0], [.5, .5], 2)
        return pipe

host = Host()
# ---------- end program_host ----------
text_block = UiTextBlock(Text="Awaiting...")
rt_mode = BooleanToggle(True)
debug = BooleanToggle(False)

button = UiButton(Label="Reset preservation")
button_2 = UiButton(Label="Preserve stages")
button_3 = UiButton(Label="Auto-merge")
merge = Merge(Data1=button_2, Data2=button, Data3=button_3)
stack = UiStackLayout(Elements=merge, Horizontal=True)

button_4 = UiButton(Label="Cancel")
button_5 = UiButton(Label="AutoComplete")
merge_2 = Merge(Data1=button_5, Data2=button_4)
stack_2 = UiStackLayout(Elements=merge_2, Horizontal=True)

check_box = UiCheckBox(Label="View groups", State=False)
check_box_2 = UiCheckBox(Label="View assignment", State=False)
merge_3 = Merge(Data1=check_box, Data2=check_box_2)
stack_3 = UiStackLayout(Elements=merge_3, Horizontal=True)

button_6 = UiButton(Label="Pluck edges")
button_7 = UiButton(Label="Pick edges to pluck")
button_8 = UiButton(Label="Reset picks")
merge_4 = Merge(Data1=button_7, Data2=button_8, Data3=button_6)
stack_4 = UiStackLayout(Elements=merge_4, Horizontal=True)

check_box_3 = UiCheckBox(Label="View hints", State=False)
check_box_4 = UiCheckBox(Label="View assignment", State=False)
merge_5 = Merge(Data1=check_box_3, Data2=check_box_4)
stack_5 = UiStackLayout(Elements=merge_5, Horizontal=True)

button_9 = UiButton(Label="AutoComplete")
button_10 = UiButton(Label="Cancel")
merge_6 = Merge(Data1=button_9, Data2=button_10)
stack_6 = UiStackLayout(Elements=merge_6, Horizontal=True)

button_11 = UiButton(Label="Pluck stages")
button_12 = UiButton(Label="Pick stages to pluck")
button_13 = UiButton(Label="Reset picks")
merge_7 = Merge(Data1=button_12, Data2=button_13, Data3=button_11)
stack_7 = UiStackLayout(Elements=merge_7, Horizontal=True)

panel = Panel("""None
Build cost
Orthogonal first
Rotation first
Translation first
Z-DOF first""")
dropdown_list = UiDropdownList(Values=panel, Index=1)
scroll_number = UiScrollNumber(Label="Magnitude multiplier", Number=1, Wrap=False, Digits=3)
button_14 = UiButton(Label="Heuristics biasing")
dropdown_list_2 = UiDropdownList(Values=panel, Index=2)
merge_8 = Merge(Data1=dropdown_list_2, Data2=dropdown_list, Data3=scroll_number, Data4=button_14)
stack_8 = UiStackLayout(Elements=merge_8, Horizontal=False)

button_15 = UiButton(Label="Assign group")
button_16 = UiButton(Label="Reset assignment")
button_17 = UiButton(Label="Merge stages")
merge_9 = Merge(Data1=button_15, Data2=button_16, Data3=button_17)
stack_9 = UiStackLayout(Elements=merge_9, Horizontal=True)

check_box_5 = UiCheckBox(Label="View hints", State=False)
check_box_6 = UiCheckBox(Label="View assignment", State=False)
merge_10 = Merge(Data1=check_box_5, Data2=check_box_6)
stack_10 = UiStackLayout(Elements=merge_10, Horizontal=True)

button_18 = UiButton(Label="AutoComplete")
button_19 = UiButton(Label="Cancel")
merge_11 = Merge(Data1=button_18, Data2=button_19)
stack_11 = UiStackLayout(Elements=merge_11, Horizontal=True)

check_box_7 = UiCheckBox(Label="View hints", State=False)
check_box_8 = UiCheckBox(Label="View assignment", State=False)
merge_12 = Merge(Data1=check_box_7, Data2=check_box_8)
stack_12 = UiStackLayout(Elements=merge_12, Horizontal=True)

button_20 = UiButton(Label="AutoComplete")
button_21 = UiButton(Label="Cancel")
merge_13 = Merge(Data1=button_20, Data2=button_21)
stack_13 = UiStackLayout(Elements=merge_13, Horizontal=True)

config = Python3Script(host=program_host.host, RTmode=rt_mode, debug=debug, visScale=Slider(0.1, range=0..1))  # -> out, host; inputs visScale: Double
# ---------- config: Python ----------
host.RTmode = RTmode
host.debug = debug
host.visScale = visScale
# ---------- end config ----------

button_22 = UiButton(Label="Solve")
button_23 = UiButton(Label="Analyze")
merge_14 = Merge(Data1=button_22, Data2=button_23)
stack_14 = UiStackLayout(Elements=merge_14, Horizontal=True)

button_24 = UiButton(Label="Undo")
button_25 = UiButton(Label="Redo")
merge_15 = Merge(Data1=button_24, Data2=button_25)
stack_15 = UiStackLayout(Elements=merge_15, Horizontal=True)

panel_2 = Panel("""Topology simplification
Linear edges
Edge culling
Transmission decoupling""")
panel_3 = Panel(""" 
 
 
 """)
label = UiLabel(Label=panel_3)
button_26 = UiButton(Label=panel_2)
label_2 = UiLabel(Label="Design status check")
merge_16 = Merge(Data1=graft(label), Data2=graft(button_26))
graphics = UiSetGraphics(Element=button_26, AccentColor=ColourSwatch(SwatchColor=RGB(255, 255, 255)))
stack_16 = UiStackLayout(Elements=merge_16, Horizontal=True)  # -> flatten(Element)
merge_17 = Merge(Data1=label_2, Data2=stack_16)
stack_17 = UiStackLayout(Elements=merge_17, Horizontal=False)

panel_4 = Panel("""False
True
False""")
panel_5 = Panel("""Origin
Stage centroid
other(specify)""")
label_3 = UiLabel(Label="Center of motion")
button_27 = UiButton(Label="Select center")
radio = UiRadio(Label=panel_5, State=panel_4, Group="Center of motion")
merge_18 = Merge(Data1=label_3, Data2=radio, Data3=button_27)
stack_18 = UiStackLayout(Elements=merge_18, Horizontal=True)

locator_2 = CSharpScript(tar="Core engine")  # -> out, id; inputs tar: String; same code as locator

panel_6 = Panel("""True
False""")
panel_7 = Panel("""Input
Output""")
label_4 = UiLabel(Label="Kind")
radio_2 = UiRadio(Label=panel_7, State=panel_6, Group="Kind")
merge_19 = Merge(Data1=label_4, Data2=radio_2)
stack_19 = UiStackLayout(Elements=merge_19, Horizontal=True)

core_engine = Python3Script(host=config.host)  # -> out, host; unedited script template
py3 = Python3Script(host=core_engine.host)  # -> out, host, save, load
# ---------- py3: Python ----------
save = "Save!"
load = "Load!"
# ---------- end py3 ----------
disc = Python3Script(host=core_engine.host)  # -> out, selBox, resX, resY, resZ, discretize, trim, addStage, addJoint, update
# ---------- disc: Python ----------
selBox = "Set domain box"

resX, resY, resZ = 1, 1, 1
info = host.editor.discretizer.prev
if(info is not None):
    resX, resY, resZ = host.editor.discretizer.prev["res"]

discretize = "Discretize"
trim = "Trim"
addStage = "Add stage"
addJoint = "Add joint"
update = "Update"
# ---------- end disc ----------

button_28 = UiButton(Label=py3.save)
save_btn = UiSaveButton(Label="Select save file path...", Extensions="JSON file|.json")
merge_20 = Merge(Data1=save_btn, Data2=button_28)
stack_20 = UiStackLayout(Elements=merge_20, Horizontal=True)

load_btn = UiLoadButton(Label="Select load file path...", Extensions="JSON file|.json", Multiple=False)
button_29 = UiButton(Label=py3.load)
merge_21 = Merge(Data1=load_btn, Data2=button_29)
stack_21 = UiStackLayout(Elements=merge_21, Horizontal=True)

panel_8 = Panel(disc.selBox)
rh_sel_btn = UiRhinoSelectButton(Label=panel_8, Filter=16)
slider = UiSlider(Label="X", Value=disc.resX, Bounds=Domain(1, 10), Increment=1)
slider_2 = UiSlider(Label="Y", Value=disc.resY, Bounds=Domain(1, 10), Increment=1)
slider_3 = UiSlider(Label="Z", Value=disc.resZ, Bounds=Domain(1, 10), Increment=1)
button_30 = UiButton(Label=disc.discretize)
merge_22 = Merge(Data1=rh_sel_btn, Data2=slider, Data3=slider_2, Data4=slider_3, Data5=button_30)
stack_22 = UiStackLayout(Elements=merge_22, Horizontal=False)
expander = UiExpanderLayout(Elements=stack_22, Title="Discretization", Direction=0, Closed=False)

panel_9 = Panel("Trim")
rh_sel_btn_2 = UiRhinoSelectButton(Label="Set trim shape", Filter=16)
button_31 = UiButton(Label=disc.trim)
merge_23 = Merge(Data1=rh_sel_btn_2, Data2=button_31)
stack_23 = UiStackLayout(Elements=merge_23, Horizontal=True)
expander_2 = UiExpanderLayout(Elements=stack_23, Title="Trim", Direction=0, Closed=False)

panel_10 = Panel("Add stage")
panel_11 = Panel("Update")
panel_12 = Panel("Add joint")
button_32 = UiButton(Label=disc.addStage)
button_33 = UiButton(Label=disc.update)
button_34 = UiButton(Label=disc.addJoint)
merge_24 = Merge(Data1=button_32, Data2=button_34, Data3=button_33)
stack_24 = UiStackLayout(Elements=merge_24, Horizontal=True)
expander_3 = UiExpanderLayout(Elements=stack_24, Title="Edit", Direction=0, Closed=False)

goal_engine = Python3Script(host=core_engine.host)  # -> out, host, count, modeCount, configIds, fixedIds
# ---------- goal_engine: Python ----------
modeCount = host.objectives.count
count = "Mode count"
configIds = [mode.configId for mode in host.objectives.modes]
fixedIds = [mode.groundId for mode in host.objectives.modes]
# ---------- end goal_engine ----------
panel_13 = Panel(goal_engine.modeCount)
merge_25 = Merge(Data1=stack_20, Data2=stack_21, Data3=text_block)
series = Series(Start=0, Step=1, Count=panel_13)
py3_2 = Python3Script(mIds=series)  # -> out, viewNone, modeName; inputs mIds: list of Int32
# ---------- py3_2: Python ----------
modeName = []

viewNone = "No preview"

for mId in mIds:
    modeName += ["Mode %d" % mId]
# ---------- end py3_2 ----------
stack_25 = UiStackLayout(Elements=merge_25, Horizontal=False)

panel_14 = Panel("""Displacement
(Deg, mm)""")
panel_15 = Panel("""Rot-X
Rot-Y
Rot-Z
Trans-X
Trans-Y
Trans-Z""")
panel_16 = Panel()
label_5 = UiLabel(Label=panel_14)
scroll_number_2 = UiScrollNumber(Label=panel_15, Number=0, Wrap=False, Digits=3)
stack_26 = UiStackLayout(Elements=scroll_number_2, Horizontal=False)
text_block_2 = UiTextBlock(Text=panel_16)
merge_26 = Merge(Data1=label_5, Data2=stack_26, Data3=text_block_2)
stack_27 = UiStackLayout(Elements=merge_26, Horizontal=True)

panel_17 = Panel("Max iteration (-1 to 10, -1: unbounded, 0: calculate displacement)")
label_6 = UiLabel(Label=panel_17)
scroll_integer = UiScrollInteger(SelectedInteger=1, Wrap=False, Bounds=Domain(0, 10))

repeat = RepeatData(Data="Preview", Length=panel_13)
merge_27 = Merge(Data1=py3_2.viewNone, Data2=repeat)
repeat_2 = RepeatData(Data="Add motion", Length=panel_13)
repeat_3 = RepeatData(Data="ResetMotions", Length=panel_13)
button_35 = UiButton(Label=repeat_2)
button_36 = UiButton(Label=repeat_3)
radio_3 = UiRadio(Label=merge_27, State=False, Group="Motion preview")
flip = FlipMatrix(Data=button_35)
flip_2 = FlipMatrix(Data=button_36)
cull_i = CullIndex(List=radio_3, Indices=0, Wrap=True)
item = ListItem(List=radio_3, Index=0, Wrap=True)
flip_3 = FlipMatrix(Data=cull_i)
path_mapper = PathMapper(flip_3, source="{A;B;C}", target="{A;C}")
merge_28 = Merge(Data1=flip, Data2=flip_2, Data3=path_mapper)
stack_28 = UiStackLayout(Elements=merge_28, Horizontal=True)

button_37 = UiButton(Label="Submit")
button_38 = UiButton(Label="Cancel")
merge_29 = Merge(Data1=button_37, Data2=button_38)
stack_29 = UiStackLayout(Elements=merge_29, Horizontal=True)

state_engine = Python3Script(host=core_engine.host)  # -> out, host
# ---------- state_engine: Python ----------
"""Grasshopper Script Instance"""
import System
import Rhino
import Grasshopper

import rhinoscriptsyntax as rs



class MyComponent(Grasshopper.Kernel.GH_ScriptInstance):
    def __init__(self):
        self.iter = 0

    def RunScript(self, host):
        self.iter += 1
        
        print(self.iter)

        return host
# ---------- end state_engine ----------
expander_4 = UiExpanderLayout(Elements=stack_25, Title="Save/Load", Direction=0, Closed=False)

merge_30 = Merge(Data1=expander, Data2=expander_2, Data3=expander_3, Data4=expander_4)
scroll = UiScrollLayout(Elements=merge_30, Horizontal=0, Vertical=0)

locator_3 = CSharpScript(tar="State engine")  # -> out, id; inputs tar: String; same code as locator

button_39 = UiButton(Label="Select node(s)")
check_box_9 = UiCheckBox(Label="Preview", State=False)
merge_31 = Merge(Data1=button_39, Data2=check_box_9)
stack_30 = UiStackLayout(Elements=merge_31, Horizontal=True)

repeat_4 = RepeatData(Data="Fixed stage ID", Length=panel_13)
repeat_5 = RepeatData(Data="Select", Length=panel_13)
scroll_integer_2 = UiScrollInteger(Label=repeat_4, SelectedInteger=goal_engine.fixedIds, Wrap=False)
button_40 = UiButton(Label=repeat_5)
flip_4 = FlipMatrix(Data=scroll_integer_2)
flip_5 = FlipMatrix(Data=button_40)
merge_32 = Merge(Data1=flip_4, Data2=flip_5)
stack_31 = UiStackLayout(Elements=merge_32, Horizontal=True)

repeat_6 = RepeatData(Data="Configuration", Length=panel_13)
repeat_7 = RepeatData(Data="Delete", Length=panel_13)
scroll_integer_3 = UiScrollInteger(Label=repeat_6, SelectedInteger=goal_engine.configIds, Wrap=False)
button_41 = UiButton(Label=repeat_7)
flip_6 = FlipMatrix(Data=scroll_integer_3)
flip_7 = FlipMatrix(Data=button_41)
merge_33 = Merge(Data1=flip_6, Data2=flip_7)
stack_32 = UiStackLayout(Elements=merge_33, Horizontal=True)

panel_18 = Panel("""Design is not validated.

Please click "Analyze" to get a summary of design suggestions.

Alternatively, click "Solve" to automate design iterations.""")

merge_34 = Merge(Data1=stack_3, Data2=stack_9, Data3=stack, Data4=stack_2)
scroll_2 = UiScrollLayout(Elements=merge_34, Horizontal=0, Vertical=0)

merge_35 = Merge(Data1=stack_5, Data2=stack_7, Data3=stack_6)
scroll_3 = UiScrollLayout(Elements=merge_35, Horizontal=0, Vertical=0)

panel_19 = Panel(state_engine.out)

merge_36 = Merge(Data1=stack_12, Data2=stack_4, Data3=stack_13)
scroll_4 = UiScrollLayout(Elements=merge_36, Horizontal=0, Vertical=0)

merge_37 = Merge(Data1=label_6, Data2=scroll_integer, Data3=stack_14)

get_values = UiValues(Element=rh_sel_btn_2)
get_values_2 = UiValues(Element=button_31)

get_values_3 = UiValues(Element=save_btn)
get_values_4 = UiValues(Element=button_28)
get_values_5 = UiValues(Element=load_btn)
get_values_6 = UiValues(Element=button_29)

get_values_7 = UiValues(Element=button_32)
get_values_8 = UiValues(Element=button_34)
get_values_9 = UiValues(Element=button_33)

get_values_10 = UiValues(Element=rh_sel_btn)
get_values_11 = UiValues(Element=slider)
get_values_12 = UiValues(Element=slider_2)
get_values_13 = UiValues(Element=slider_3)
get_values_14 = UiValues(Element=button_30)

stack_33 = UiStackLayout(Elements=merge_37, Horizontal=False)

panel_20 = Panel(goal_engine.count)
scroll_integer_4 = UiScrollInteger(Label=panel_20, SelectedInteger=goal_engine.modeCount, Wrap=False)
merge_38 = Merge(Data1=scroll_integer_4, Data2=item)  # -> flatten(Result)
stack_34 = UiStackLayout(Elements=merge_38, Horizontal=True)

text_block_3 = UiTextBlock(Text=panel_18)
panel_21 = Panel(get_values_6)
panel_22 = Panel(get_values_3)
panel_23 = Panel(get_values_4)
panel_24 = Panel(get_values_5)
brep = Brep(get_values_10)

number_slider = Slider(2, range=1..5)
number_slider_2 = Slider(2, range=1..5)
number_slider_3 = Slider(2, range=1..5)
button_42 = Button()
box = Box({Plane=Plane(origin=(6, 1, 0), x=(0.5547001962, 0.8320502943, 0), y=(0.8320502943, -0.5547001962, 0)), X=Domain(0, 3.605551275), Y=Domain(0, 1.664100589), Z=Domain(-2, 0)})
discretizer = Python3Script(host=state_engine.host, reset=get_values_14, dBox=get_values_10, x=get_values_11, y=get_values_12, z=get_values_13)  # -> out, refire; inputs dBox: Brep, x: Int32, y: Int32, z: Int32
# ---------- discretizer: Python ----------
refire = host.editor.discretize(dBox, x, y, z, reset)
# ---------- end discretizer ----------

get_values_15 = UiValues(Element=check_box)
get_values_16 = UiValues(Element=check_box_2)
get_values_17 = UiValues(Element=button_15)
get_values_18 = UiValues(Element=button_16)
get_values_19 = UiValues(Element=button_17)
get_values_20 = UiValues(Element=button_2)
get_values_21 = UiValues(Element=button)
get_values_22 = UiValues(Element=button_3)
get_values_23 = UiValues(Element=button_5)
get_values_24 = UiValues(Element=button_4)
resize = UiResize(Element=text_block_3, Width=Slider(150, range=0..500))
get_values_25 = UiValues(Element=check_box_3)
get_values_26 = UiValues(Element=check_box_4)
get_values_27 = UiValues(Element=button_12)
get_values_28 = UiValues(Element=button_13)
get_values_29 = UiValues(Element=button_11)
get_values_30 = UiValues(Element=button_9)
get_values_31 = UiValues(Element=button_10)

direct_editor = Python3Script(host=state_engine.host)  # -> out, nodes, edges, push
# ---------- direct_editor: Python ----------
if(host is not None):

    parser = host.parser
    
    nodes = parser.nodes
    edges = parser.edges
    edgePts = parser.edgePts
    edgeStart, edgeEnd = parser.edgeStart, parser.edgeEnd
    nodesId = parser.nodesId
    nodesInfo = parser.nodesInfo
    edgesId = parser.edgesId
    edgesInfo = parser.edgesInfo
    axis, rotMag, transMag, refPt = parser.axis, parser.rotMag, parser.transMag, parser.refPt
    isRigid = parser.isRigid
    scale = parser.scale
    ioIds = parser.ioIds
    fixedIds = parser.fixedIds
    jointScrew = parser.jointScrew

    push = host.editor.push
    if(host.editor.push): host.editor.push = False
# ---------- end direct_editor ----------
cache = ContentCache(Content=direct_editor.nodes, Action=direct_editor.push)
cache_2 = ContentCache(Content=direct_editor.edges, Action=direct_editor.push)
pt = Point(cache)
crv = Curve(cache_2)

get_values_32 = UiValues(Element=check_box_7)
get_values_33 = UiValues(Element=check_box_8)
get_values_34 = UiValues(Element=button_7)
get_values_35 = UiValues(Element=button_8)
get_values_36 = UiValues(Element=button_6)
get_values_37 = UiValues(Element=button_20)
get_values_38 = UiValues(Element=button_21)
get_values_39 = UiValues(Element=check_box_5)
get_values_40 = UiValues(Element=check_box_6)
get_values_41 = UiValues(Element=dropdown_list_2)
get_values_42 = UiValues(Element=dropdown_list)
get_values_43 = UiValues(Element=scroll_number)
get_values_44 = UiValues(Element=button_14)
get_values_45 = UiValues(Element=button_18)
get_values_46 = UiValues(Element=button_19)
preview = CustomPreview(Geometry=brep, Material=ColourSwatch(SwatchColor=RGBA(128, 128, 128, 109)))
merge_39 = Merge(Data1=stack_17, Data2=resize)
merge_40 = Merge(Data1=stack_30, Data2=stack_18, Data3=stack_19, Data4=stack_27, Data5=stack_29)
show_node_point = BooleanToggle(False)
show_edge_point = BooleanToggle(False)
show_node_box = BooleanToggle(True)
show_edge_line = BooleanToggle(False)
show_node_tag = BooleanToggle(False)
show_edge_tag = BooleanToggle(False)
stack_35 = UiStackLayout(Elements=merge_39, Horizontal=True)
merge_41 = Merge(Data1=stack_33, Data2=stack_15, Data3=stack_35)
scroll_5 = UiScrollLayout(Elements=merge_41, Horizontal=0, Vertical=0)
scroll_6 = UiScrollLayout(Elements=merge_40, Horizontal=0, Vertical=0)

get_values_47 = UiValues(Element=button_24)
get_values_48 = UiValues(Element=button_25)

get_values_49 = UiValues(Element=scroll_integer)
get_values_50 = UiValues(Element=button_22)
get_values_51 = UiValues(Element=button_23)

get_values_52 = UiValues(Element=button_26)  # -> flatten(Values)
sl = Python3Script(host=config.host, savePath=get_values_3, save=get_values_4, loadPath=get_values_5, load=get_values_6)  # -> out, message, refire
# ---------- sl: Python ----------
message = []
refire = False
dBox, resX, resY, resZ =[], [], [], []

if(save): 
    message, refire = host.save(savePath)
if(load):
    message, refire = host.load(loadPath)
# ---------- end sl ----------

graphics_2 = UiSetGraphics(
    Element=button_41,
    PrimaryColor=ColourSwatch(SwatchColor=RGB(255, 255, 255)),
    AccentColor=ColourSwatch(SwatchColor=RGB(255, 0, 0)),
    StrokeColor=ColourSwatch(SwatchColor=RGB(191, 0, 0)),
    StrokeWeight=Slider(2, range=0..10))

merge_42 = Merge(Data1=stack_32, Data2=stack_31, Data3=stack_28)

get_values_53 = UiValues(Element=radio)  # -> flatten(Values)
get_values_54 = UiValues(Element=button_27)

get_values_55 = UiValues(Element=radio_2)  # -> flatten(Values)
get_values_56 = UiValues(Element=scroll_number_2)  # -> flatten(Values)

get_values_57 = UiValues(Element=button_37)
get_values_58 = UiValues(Element=button_38)

get_values_59 = UiValues(Element=check_box_9)
get_values_60 = UiValues(Element=button_39)
panel_25 = Panel(get_values_49)
panel_26 = Panel(get_values_48)
panel_27 = Panel(get_values_52)
panel_28 = Panel(get_values_50)
panel_29 = Panel(get_values_51)
panel_30 = Panel(get_values_47)
visualizer = Visualizer(
    host=state_engine.host,
    show_node_pt=show_node_point,
    show_edge_pt=show_edge_point,
    show_node_box=show_node_box,
    show_edge_line=show_edge_line,
    show_node_tag=show_node_tag,
    show_edge_tag=show_edge_tag)  # -> node_pts_2, edge_pts_2, node_box_2, edge_line_2, text_entity_5, text_entity_6
expander_5 = UiExpanderLayout(Elements=merge_42, Title=graft(py3_2.modeName), Direction=0, Closed=True)  # -> flatten(Element)
panel_31 = Panel("""Topology
Goals
Solver
Preview
Joint modeling""")
larger = LargerThan(FirstNumber=panel_13, SecondNumber=0)  # -> LargerThan, OrEqualTo
panel_32 = Panel(get_values_60)
text_block_4 = UiTextBlock(Element=text_block, Text=sl.message)

button_43 = Button()
dispatch = Dispatch(List=pt, DispatchPattern=get_values_2)  # -> ListA, ListB
trimshape = Brep(get_values)
brepsinc = PointInBreps(Brep=trimshape, Point=dispatch.ListA, Strict=False)  # -> Inside, Index
trim_graph = Python3Script(host=core_engine.host, nodes=pt, edges=crv, mask=brepsinc.Inside)  # -> out, update; inputs nodes: list of Point3d, edges: list of Curve, mask: list of Boolean
# ---------- trim_graph: Python ----------
update = host.editor.trim(nodes, edges, mask)
# ---------- end trim_graph ----------

button_44 = Button()
button_45 = Button()
add_element = Python3Script(host=core_engine.host, addNode=get_values_7, addEdge=get_values_8)  # -> out, update
# ---------- add_element: Python ----------
if(addNode):
    update = host.editor.addNode()
elif(addEdge):
    update = host.editor.addEdge()
else:
    update = False
# ---------- end add_element ----------

solver_changes = Python3Script(
    host=core_engine.host,
    maxIter=get_values_49,
    solve=get_values_50,
    analyze=get_values_51,
    undo=get_values_47,
    redo=get_values_48,
    helperInit=get_values_52)  # -> out, host, refire, message, helper, helperDispatch; inputs maxIter: Int32, solve: Boolean, helperInit: list of Boolean
# ---------- solver_changes: Python ----------
host.solver.setIter(maxIter)

refire = False
if(solve):
    refire = host.solver.solve()
if(analyze):
    refire = host.solver.analyze()
if(undo):
    refire = host.undo()
if(redo):
    refire = host.redo()

helper = host.solver.getHelper(helperInit)
if(not isinstance(helper, list)):
    helperDispatch = helper.dispatch
else:
    helperDispatch = []

message = host.solver.genMessage()
# ---------- end solver_changes ----------
swatch = ColourSwatch(SwatchColor=RGB(120, 120, 120))
brep_2 = Brep(visualizer.node_box_2)
locator_4 = CSharpScript(tar="Decouple fixer monitor")  # -> out, id; inputs tar: String; same code as locator
locator_5 = CSharpScript(tar="Solver changes")  # -> out, id; inputs tar: String; same code as locator
dispatch_2 = Dispatch(List=expander_5, DispatchPattern=larger.LargerThan)  # -> ListA, ListB
volume = Volume(Geometry=visualizer.node_box_2)  # -> Volume, Centroid
item_2 = ListItem(List=visualizer.node_box_2, Index=Slider(9, range=0..10), Wrap=True)
merge_43 = Merge(Data1=stack_34, Data2=dispatch_2.ListA)
preview_2 = CustomPreview(Geometry=visualizer.text_entity_5, Material=swatch)
preview_3 = CustomPreview(Geometry=visualizer.text_entity_6, Material=swatch)

button_46 = Button()
edit_updater = Python3Script(host=core_engine.host, update=get_values_9, nodes=pt, edges=crv)  # -> out, update; inputs update: Boolean, nodes: list of Point3d, edges: list of Curve
# ---------- edit_updater: Python ----------
if(host.RTmode or update):
    update = host.editor.monitorTopo(nodes, edges)
else:
    update = False
# ---------- end edit_updater ----------

scale = Scale(Geometry=visualizer.node_box_2, Center=volume.Centroid, Factor=0.99)  # -> Geometry, Transform
gate = StreamGate(Stream=solver_changes.helper, Gate=solver_changes.helperDispatch)  # -> Target0, Target1, Target2, Target3
linear_edge_removal = Python3Script(
    helper=gate.Target1,
    pickStages=get_values_27,
    resetStages=get_values_28,
    manualPluck=get_values_29,
    autoComplete=get_values_30,
    cancel=get_values_31)  # -> out, refire, helper; inputs pickStages: Boolean, resetStages: Boolean, manualPluck: Boolean, autoComplete: Boolean, cancel: Boolean
# ---------- linear_edge_removal: Python ----------
refire = []

if(helper):

    if(pickStages): helper.pick()
    if(resetStages): helper.reset()
    if(manualPluck): refire = helper.manualPluck()
    if(autoComplete): refire = helper.autoComplete()
    if(cancel): refire = helper.cancel()

    helper = [] if (isinstance(refire, bool) and refire) else helper
# ---------- end linear_edge_removal ----------
heuristics_window_control = Python3Script(helper=gate.Target1)  # -> out, dispatch, title, windowOpen
# ---------- heuristics_window_control: Python ----------
title =[]
windowOpen = False
dispatch = []
if(helper):
    title = helper.name
    windowOpen = True
    dispatch = helper.dispatch
# ---------- end heuristics_window_control ----------
topology_simplifier = Python3Script(
    helper=gate.Target0,
    viewGroups=get_values_15,
    viewAssignment=get_values_16,
    assign=get_values_17,
    resetAssignment=get_values_18,
    manualMerge=get_values_19,
    assignPreserve=get_values_20,
    resetPreservation=get_values_21,
    autoMerge=get_values_22,
    autoComplete=get_values_23,
    cancel=get_values_24)  # -> out, refire, nodes, scale, colors, edges; inputs viewGroups: Boolean, viewAssignment: Boolean, assign: Boolean, resetAssignment: Boolean, manualMerge: Boolean, assignPreserve: Boolean, resetPreservation: Boolean, autoMerge: Boolean, autoComplete: Boolean, cancel: Boolean
# ---------- topology_simplifier: Python ----------
refire = []
nodes = []
scale = []
colors = []
edges = []

if(helper):

    if(assign): helper.assignGroup()
    if(resetAssignment): helper.resetAssignment()
    if(manualMerge): refire = helper.manualMerge()
    if(assignPreserve): helper.assignPreserve()
    if(resetPreservation): helper.resetPreservation()
    if(autoMerge): refire = helper.autoMerge()
    if(autoComplete): refire = helper.autoComplete()
    if(cancel): refire = helper.cancel()

    if((not isinstance(refire, bool)) and (viewGroups or viewAssignment)):
        helper.updateColors(viewGroups, viewAssignment)
        nodes = helper.solver.host.parser.nodes
        scale = helper.solver.host.parser.scale
        colors = helper.nodeColors
    
        if(viewAssignment):
            edges = helper.mergeEdges
# ---------- end topology_simplifier ----------
heuristics_window_control_2 = Python3Script(helper=gate.Target0)  # -> out, dispatch, title, windowOpen; same code as heuristics_window_control
redundant_edge_removal = Python3Script(
    helper=gate.Target2,
    pickEdges=get_values_34,
    resetEdges=get_values_35,
    manualPluck=get_values_36,
    autoComplete=get_values_37,
    cancel=get_values_38)  # -> out, refire, helper; inputs pickEdges: Boolean, resetEdges: Boolean, manualPluck: Boolean, autoComplete: Boolean, cancel: Boolean
# ---------- redundant_edge_removal: Python ----------
refire = []

if(helper):

    if(pickEdges): helper.pick()
    if(resetEdges): helper.reset()
    if(manualPluck): refire = helper.manualPluck()
    if(autoComplete): refire = helper.autoComplete()
    if(cancel): refire = helper.cancel()

    helper = [] if (isinstance(refire, bool) and refire) else helper
# ---------- end redundant_edge_removal ----------
heuristics_window_control_3 = Python3Script(helper=gate.Target2)  # -> out, dispatch, title, windowOpen; same code as heuristics_window_control
heuristics_window_control_4 = Python3Script(helper=gate.Target3)  # -> out, dispatch, title, windowOpen; same code as heuristics_window_control
view = Python3Script(helper=linear_edge_removal.helper, viewHints=get_values_25, viewAssignment=get_values_26)  # -> out, nodes, nodeColors, edges, edgeColors, scale
# ---------- view: Python ----------
nodes = []
edges = []
scale = []
nodeColors = []
edgeColors = []

if(helper and (viewHints or viewAssignment)):
    helper.updateColors(viewHints, viewAssignment)
    nodes = helper.solver.host.parser.nodes
    edges = helper.solver.host.parser.edges
    scale = helper.solver.host.parser.scale
    nodeColors = helper.nodeColors
    edgeColors = helper.edgeColors
# ---------- end view ----------
num = Number(topology_simplifier.scale)
view_2 = Python3Script(helper=redundant_edge_removal.helper, viewHints=get_values_32, viewAssignment=get_values_33)  # -> out, nodes, nodeColors, edges, edgeColors, scale; same code as view
window = UiWindow(
    Elements=scroll_3,
    Title=heuristics_window_control.title,
    Owner=2,
    Scroll=True,
    Launch=heuristics_window_control.windowOpen)
window_2 = UiWindow(
    Elements=scroll_4,
    Title=heuristics_window_control_3.title,
    Owner=2,
    Scroll=True,
    Launch=heuristics_window_control_3.windowOpen)
window_3 = UiWindow(
    Elements=scroll_2,
    Title=heuristics_window_control_2.title,
    Owner=2,
    Scroll=True,
    Launch=heuristics_window_control_2.windowOpen)
box_2 = CenterBox(Base=topology_simplifier.nodes, X=num, Y=num, Z=num)
pipe = Pipe(Curve=topology_simplifier.edges, Radius=num, Caps=0)
preview_4 = CustomPreview(Geometry=item_2, Material=ColourSwatch(SwatchColor=RGBA(255, 0, 128, 109)))
scroll_7 = UiScrollLayout(Elements=merge_43, Horizontal=0, Vertical=0)
preview_5 = CustomPreview(Geometry=visualizer.edge_line_2, Material=swatch)
preview_6 = CustomPreview(Geometry=box_2, Material=topology_simplifier.colors)
preview_7 = CustomPreview(Geometry=pipe, Material=ColourSwatch(SwatchColor=RGB(186, 186, 186)))
text_block_5 = UiTextBlock(Element=text_block_3, Text=solver_changes.message)
py3_3 = Python3Script(host=solver_changes.host)  # -> out, names, colors
# ---------- py3_3: Python ----------
names, colors = host.solver.unpackStatus()
# ---------- end py3_3 ----------
refire_bus = Python3Script(host=config.host, solve=solver_changes.refire)  # -> locked, refire
# ---------- refire_bus: Python ----------
"""Grasshopper Script"""

import System
import Rhino
import Grasshopper

import rhinoscriptsyntax as rs


class MyComponent(Grasshopper.Kernel.GH_ScriptInstance):
    def RunScript(self, host, solve):
        
        refire = any([
            solve,
        ])

        locked = host.refireLock
        refire = refire and not host.refireLock

        return host.refireLock, True if refire else []
# ---------- end refire_bus ----------
refire_trigger = CSharpScript(tar=locator_2.id, trigger=sl.refire, millis=Slider(1, range=0..100))  # inputs tar: Guid, trigger: Boolean, millis: Int32
# ---------- refire_trigger: C# ----------
// Grasshopper Script Instance
#region Usings
using System;
using System.Linq;
using System.Collections;
using System.Collections.Generic;
using System.Drawing;

using Rhino;
using Rhino.Geometry;

using Grasshopper;
using Grasshopper.Kernel;
using Grasshopper.Kernel.Data;
using Grasshopper.Kernel.Types;
#endregion

public class Script_Instance : GH_ScriptInstance
{
    #region Notes
    /* 
      Members:
        RhinoDoc RhinoDocument
        GH_Document GrasshopperDocument
        IGH_Component Component
        int Iteration

      Methods (Virtual & overridable):
        Print(string text)
        Print(string format, params object[] args)
        Reflect(object obj)
        Reflect(object obj, string method_name)
    */
    #endregion

    #region Members
    private readonly GH_Document GrasshopperDocument;
    private readonly IGH_Component Component;
    int iter = 0;
    #endregion

    private void RunScript(Guid tar, bool trigger, int millis)
    {
        
        // get target component
        IGH_Component comp = GrasshopperDocument.FindComponent(tar);
        
        // trigger refire
        if(trigger){
            this.iter += 1;
            comp.OnPingDocument().ScheduleSolution(millis, doc =>
            {
                comp.ExpireSolution(false);
            });
            }

    }
}
# ---------- end refire_trigger ----------
num_2 = Number(view.scale)
preview_8 = CustomPreview(Geometry=scale.Geometry, Material=ColourSwatch(SwatchColor=RGBA(128, 128, 128, 64)))
num_3 = Number(view_2.scale)
get_values_61 = UiValues(Element=scroll_integer_4)

get_values_62 = UiValues(Element=button_36)  # -> flatten(Values)
get_values_63 = UiValues(Element=scroll_integer_3)  # -> flatten(Values)
get_values_64 = UiValues(Element=button_41)  # -> flatten(Values)
get_values_65 = UiValues(Element=scroll_integer_2)  # -> flatten(Values)
get_values_66 = UiValues(Element=button_40)  # -> flatten(Values)
get_values_67 = UiValues(Element=button_35)  # -> flatten(Values)

pipe_2 = Pipe(Curve=view.edges, Radius=expr("x*.1", view.scale), Caps=0)  # -> flatten(Pipe)
get_values_68 = UiValues(Element=radio_3)  # -> flatten(Values)
pipe_3 = Pipe(Curve=view_2.edges, Radius=expr("x*.1", view_2.scale), Caps=0)  # -> flatten(Pipe)
box_3 = CenterBox(Base=view.nodes, X=num_2, Y=num_2, Z=num_2)
merge_44 = Merge(Data1=ColourSwatch(SwatchColor=RGB(236, 100, 43)), Data2=ColourSwatch(SwatchColor=RGB(0, 120, 255)))
box_4 = CenterBox(Base=view_2.nodes, X=num_3, Y=num_3, Z=num_3)
panel_33 = Panel(refire_bus.locked)
refire_bus_2 = Python3Script(host=core_engine.host, iterate=topology_simplifier.refire)  # -> locked, refire
# ---------- refire_bus_2: Python ----------
"""Grasshopper Script"""

import System
import Rhino
import Grasshopper

import rhinoscriptsyntax as rs


class MyComponent(Grasshopper.Kernel.GH_ScriptInstance):
    def RunScript(self, host, iterate):
        
        refire = any([
            iterate,
        ])

        locked = host.refireLock
        refire = refire and not host.refireLock

        return host.refireLock, True if refire else []
# ---------- end refire_bus_2 ----------
graphics_3 = UiSetGraphics(Element=label, AccentColor=py3_3.colors)
rec = DataRecorder(solver_changes.out, DataLimit=-10, RecordData=True)
refire_bus_3 = Python3Script(host=core_engine.host, iterate=linear_edge_removal.refire)  # -> locked, refire; same code as refire_bus_2
refire_bus_4 = Python3Script(host=core_engine.host, iterate=redundant_edge_removal.refire)  # -> locked, refire; same code as refire_bus_2
preview_9 = CustomPreview(Geometry=box_3, Material=view.nodeColors)
preview_10 = CustomPreview(Geometry=pipe_2, Material=view.edgeColors)
preview_11 = CustomPreview(Geometry=box_4, Material=view_2.nodeColors)
dispatch_3 = Dispatch(List=merge_44, DispatchPattern=get_values_55)  # -> ListA, ListB
preview_12 = CustomPreview(Geometry=pipe_3, Material=view_2.edgeColors)
refire_bus_5 = Python3Script(
    host=config.host,
    disc=discretizer.refire,
    push=direct_editor.push,
    edit=edit_updater.update,
    trim=trim_graph.update,
    add=add_element.update)  # -> locked, refire
# ---------- refire_bus_5: Python ----------
"""Grasshopper Script"""

import System
import Rhino
import Grasshopper

import rhinoscriptsyntax as rs


class MyComponent(Grasshopper.Kernel.GH_ScriptInstance):
    def RunScript(self, host, disc, push, edit, trim, add):
        
        refire = any([
        disc,
        push,
        edit,
        trim,
        add,
        ])

        locked = host.refireLock
        refire = refire and not host.refireLock

        return host.refireLock, True if refire else []
# ---------- end refire_bus_5 ----------
panel_34 = Panel(refire_bus_2.locked)
panel_35 = Panel(refire_bus_3.locked)
refire_trigger_2 = CSharpScript(tar=locator_3.id, trigger=refire_bus.refire, millis=Slider(1, range=0..100))  # inputs tar: Guid, trigger: Boolean, millis: Int32; same code as refire_trigger
panel_36 = Panel(refire_bus_4.locked)
panel_37 = Panel(refire_bus_5.locked)
panel_38 = Panel(rec)
refire_trigger_3 = CSharpScript(trigger=refire_bus_2.refire, millis=Slider(1, range=0..100))  # inputs tar: Guid, trigger: Boolean, millis: Int32; same code as refire_trigger
refire_trigger_4 = CSharpScript(trigger=refire_bus_2.refire, millis=Slider(1, range=0..100))  # inputs tar: Guid, trigger: Boolean, millis: Int32; same code as refire_trigger
refire_trigger_5 = CSharpScript(trigger=refire_bus_3.refire, millis=Slider(1, range=0..100))  # inputs tar: Guid, trigger: Boolean, millis: Int32; same code as refire_trigger
refire_trigger_6 = CSharpScript(trigger=refire_bus_3.refire, millis=Slider(1, range=0..100))  # inputs tar: Guid, trigger: Boolean, millis: Int32; same code as refire_trigger
mode_updates = Python3Script(
    host=goal_engine.host,
    configId=get_values_63,
    fixedId=get_values_65,
    selFixed=get_values_66,
    addMotion=get_values_67,
    resetMotion=get_values_62)  # -> out, host, fixedId, moCons; inputs configId: list of Int32, fixedId: list of Int32, selFixed: list of Boolean, addMotion: list of Boolean, resetMotion: list of Boolean
# ---------- mode_updates: Python ----------
host.objectives.updateConfigId(configId)
host.objectives.updateFixedId(fixedId)
host.objectives.resetModePres(resetMotion)

fixedId = host.objectives.selFixed(selFixed)
moCons = host.objectives.addMotion(addMotion)
# ---------- end mode_updates ----------
spec_constructor = Python3Script(moCons=mode_updates.moCons)  # -> out, title, windowOpen
# ---------- spec_constructor: Python ----------
addNewWindow = []
title =[]
windowOpen = False
if(moCons):
    title = "New motion for mode %d" % moCons.modeId
    windowOpen = True
# ---------- end spec_constructor ----------
window_4 = UiWindow(Elements=scroll_6, Title=spec_constructor.title, Owner=2, Scroll=True, Launch=spec_constructor.windowOpen)
mode_changes = Python3Script(
    cons=mode_updates.moCons,
    selNodes=get_values_60,
    centerMode=get_values_53,
    selCenter=get_values_54,
    kind=get_values_55,
    velocity=get_values_56,
    submit=get_values_57,
    cancel=get_values_58,
    preview=get_values_59)  # -> out, message, reFire, stageCen, scale, axis, rotMag, transMag, refPt; inputs selNodes: Boolean, centerMode: list of Boolean, selCenter: Boolean, kind: list of Boolean, velocity: list of Double, submit: Boolean, cancel: Boolean, preview: Boolean
# ---------- mode_changes: Python ----------
stageCen = []
reFire = False
message = []
scale = []
disp = []

if(cons):

    _ = cons.selNodes(selNodes)
    _ = cons.selCenMode(centerMode)
    _ = cons.selCenter(selCenter)
    _ = cons.updateKind(kind)
    _ = cons.updateVel(velocity)

    summary = cons.summarize()

    prompt, reFireSubmit = cons.submit(submit)
    _, reFireCancel = cons.cancel(cancel)

    message = summary + prompt
    reFire = reFireSubmit or reFireCancel

    if(preview):
        stageCen = [cons.obj.host.parser.nodes[sId] for sId in cons.stageIds]
        scale = cons.obj.host.parser.scale
        axis, rotMag, transMag, refPt = cons.outputScrews()
# ---------- end mode_changes ----------
text_block_6 = UiTextBlock(Element=text_block_2, Text=mode_changes.message)
spec_visualizer = SpecVisualizer(
    stagecen=mode_changes.stageCen,
    scale=mode_changes.scale,
    axis=mode_changes.axis,
    rotmag=mode_changes.rotMag,
    transmag=mode_changes.transMag,
    refpt=mode_changes.refPt)  # -> stages_2, trajectory_2
refire_bus_6 = Python3Script(host=goal_engine.host, wait=text_block_6, change=mode_changes.reFire)  # -> locked, refire
# ---------- refire_bus_6: Python ----------
"""Grasshopper Script"""

import System
import Rhino
import Grasshopper

import rhinoscriptsyntax as rs


class MyComponent(Grasshopper.Kernel.GH_ScriptInstance):
    def RunScript(self, host, wait, change):
        
        refire = any([
        change,
        ])

        locked = host.refireLock
        refire = refire and not host.refireLock

        return host.refireLock, True if refire else []
# ---------- end refire_bus_6 ----------
panel_39 = Panel(refire_bus_6.locked)
preview_13 = CustomPreview(Geometry=spec_visualizer.trajectory_2, Material=dispatch_3.ListA)
preview_14 = CustomPreview(Geometry=spec_visualizer.stages_2, Material=dispatch_3.ListA)
mode_changes_2 = Python3Script(host=goal_engine.host, modeCount=get_values_61, delete=get_values_64)  # -> out, refire; inputs modeCount: Int32, delete: list of Boolean
# ---------- mode_changes_2: Python ----------
refire = False

refire = host.objectives.updateCount(modeCount)

if(not refire):
    refire = host.objectives.deleteMode(delete)
# ---------- end mode_changes_2 ----------
refire_trigger_7 = CSharpScript(trigger=refire_bus_4.refire, millis=Slider(1, range=0..100))  # inputs tar: Guid, trigger: Boolean, millis: Int32; same code as refire_trigger
refire_trigger_8 = CSharpScript(trigger=refire_bus_4.refire, millis=Slider(1, range=0..100))  # inputs tar: Guid, trigger: Boolean, millis: Int32; same code as refire_trigger
refire_trigger_9 = CSharpScript(tar=locator_3.id, trigger=refire_bus_5.refire, millis=Slider(1, range=0..100))  # inputs tar: Guid, trigger: Boolean, millis: Int32; same code as refire_trigger
locator_6 = CSharpScript(tar="Mode updates")  # -> out, id; inputs tar: String; same code as locator
refire_trigger_10 = CSharpScript(tar=locator_6.id, trigger=refire_bus_6.refire, millis=Slider(1, range=0..100))  # inputs tar: Guid, trigger: Boolean, millis: Int32; same code as refire_trigger
mode_preview = Python3Script(host=mode_updates.host, preview=get_values_68)  # -> out, stageCen, scale, axis, rotMag, transMag, refPt, colors; inputs preview: list of Boolean
# ---------- mode_preview: Python ----------
stageCen, axis, rotMag, transMag, refPt = host.objectives.preview(preview)
scale = host.parser.scale

colors = []
if(any(preview[1:])):
    mId = (preview.index(True) - 1)
    mode = host.objectives.modes[mId]
    colors += [0] # ground
    for sId in mode.pres:
        if(mode.pres[sId].kind == "inp"): colors += [1]
        elif(mode.pres[sId].kind == "out"): colors += [2]
# ---------- end mode_preview ----------
refire_bus_7 = Python3Script(host=goal_engine.host, change=mode_changes_2.refire)  # -> locked, refire
# ---------- refire_bus_7: Python ----------
"""Grasshopper Script"""

import System
import Rhino
import Grasshopper

import rhinoscriptsyntax as rs


class MyComponent(Grasshopper.Kernel.GH_ScriptInstance):
    def RunScript(self, host, change):
        
        refire = any([
        change,
        ])

        locked = host.refireLock
        refire = refire and not host.refireLock

        return host.refireLock, True if refire else []
# ---------- end refire_bus_7 ----------
scroll_integer_5 = UiScrollInteger(Element=scroll_integer_2, Label=repeat_4, SelectedInteger=mode_updates.fixedId, Wrap=False)
spec_visualizer_2 = SpecVisualizer(
    stagecen=mode_preview.stageCen,
    scale=mode_preview.scale,
    axis=mode_preview.axis,
    rotmag=mode_preview.rotMag,
    transmag=mode_preview.transMag,
    refpt=mode_preview.refPt,
    ex=Slider(1, range=0..1))  # -> stages_2, trajectory_2
panel_40 = Panel(refire_bus_7.locked)
merge_45 = Merge(
    Data1=ColourSwatch(SwatchColor=RGB(69, 69, 69)),
    Data2=ColourSwatch(SwatchColor=RGB(236, 100, 43)),
    Data3=ColourSwatch(SwatchColor=RGB(0, 120, 255)))
item_3 = ListItem(List=merge_45, Index=mode_preview.colors, Wrap=True)
refire_trigger_11 = CSharpScript(tar=locator.id, trigger=refire_bus_7.refire, millis=Slider(1, range=0..100))  # inputs tar: Guid, trigger: Boolean, millis: Int32; same code as refire_trigger
preview_15 = CustomPreview(Geometry=spec_visualizer_2.stages_2, Material=item_3)

panel_41 = Panel("""Pick from list
Manual assignment""")
radio_4 = UiRadio(Label=panel_41, State=[True, False], Group="Bias assignment mode")
item_4 = ListItem(List=radio_4, Index=0, Wrap=True)  # -> Item, Item1

preview_16 = CustomPreview(Geometry=spec_visualizer_2.trajectory_2, Material=ColourSwatch(SwatchColor=RGB(0, 0, 0)))
button_47 = UiButton(Label="init")
simulation_ui_layout = Python3Script(host=state_engine.host)  # -> out, host, reset, viewNone, configCount, modeName, configId, configName
# ---------- simulation_ui_layout: Python ----------
reset = "reset"
configId = [mode.configId for mode in host.objectives.modes]
modeName = ["Mode %d" % i for i in range(host.objectives.count)]
configName = ["Config %d" % i for i in sorted(list(set(configId)))]
viewNone = "View none"
configCount = len(configName)
# ---------- end simulation_ui_layout ----------
locator_7 = CSharpScript(tar="Simulation ui layout")  # -> out, id; inputs tar: String; same code as locator
get_values_69 = UiValues(Element=button_47)
panel_42 = Panel(get_values_69)
py3_4 = Python3Script(host=core_engine.host, init=get_values_69)  # -> out, host, names, edit, reset, status, initialized, init
# ---------- py3_4: Python ----------
names, edit, reset, status = [], [], [], []

if(init): host.modeler.initJoints()

names, edit, reset, status = host.modeler.labels()
initialized = host.modeler.initialized
init = False
# ---------- end py3_4 ----------

repeat_8 = RepeatData(Data="Preview", Length=simulation_ui_layout.configCount)
merge_46 = Merge(Data1=flatten(simulation_ui_layout.viewNone), Data2=flatten(repeat_8))
radio_5 = UiRadio(Label=merge_46, State=False, Group="Motion preview")
cull_i_2 = CullIndex(List=radio_5, Indices=0, Wrap=True)
item_5 = ListItem(List=radio_5, Index=0, Wrap=True)
flip_8 = FlipMatrix(Data=cull_i_2)

slider_4 = UiSlider(Label=simulation_ui_layout.modeName, Value=0, Bounds=Domain(0, 1), Increment=0.01)  # -> graft(Elements)
path = ConstructPath(Indices=graft(simulation_ui_layout.configId))  # -> flatten(Branch)
tstat = TreeStatistics(Tree=slider_4)  # -> Paths, Length, Count
replace = ReplacePaths(Data=slider_4, Search=tstat.Paths, Replace=path)
match = MatchTree(Tree=flip_8, Guide=replace)
merge_47 = Merge(Data1=match, Data2=replace)

get_values_70 = UiValues(Element=radio_4)  # -> flatten(Values)
label_7 = UiLabel(Label=py3_4.names)
button_48 = UiButton(Label=py3_4.edit)
button_49 = UiButton(Label=py3_4.reset)
label_8 = UiLabel(Label=py3_4.status)
button_50 = UiButton(Label=simulation_ui_layout.reset)
merge_48 = Merge(Data1=graft(label_7), Data2=graft(button_48), Data3=graft(button_49), Data4=graft(label_8))
merge_49 = Merge(Data1=button_50, Data2=item_5)
stack_36 = UiStackLayout(Elements=merge_48, Horizontal=True)  # -> flatten(Element)
stack_37 = UiStackLayout(Elements=merge_49, Horizontal=True)
get_values_71 = UiValues(Element=button_48)  # -> flatten(Values)
get_values_72 = UiValues(Element=button_49)  # -> flatten(Values)
dispatch_4 = Dispatch(List=stack_36, DispatchPattern=py3_4.initialized)  # -> flatten(ListA), ListB
expander_6 = UiExpanderLayout(Elements=merge_47, Title=graft(simulation_ui_layout.configName), Direction=0, Closed=False)  # -> flatten(Element)
merge_50 = Merge(Data1=button_47, Data2=dispatch_4.ListA)
merge_51 = Merge(Data1=stack_37, Data2=expander_6)
scroll_8 = UiScrollLayout(Elements=merge_51, Horizontal=0, Vertical=0)
py3_5 = Python3Script(host=py3_4.host, edit=get_values_71, reset=get_values_72)  # -> out, status, joint; inputs edit: list, reset: list
# ---------- py3_5: Python ----------
joint = []

if(any(edit)):
    host.modeler.edit(edit)
names, edit, reset, status = host.modeler.labels()

joint = host.modeler.editing
# ---------- end py3_5 ----------
get_values_73 = UiValues(Element=button_50)

get_values_74 = UiValues(Element=radio_5)  # -> flatten(Values)
get_values_75 = UiValues(Element=slider_4)  # -> flatten(Values)

label_9 = UiLabel(Element=label_8, Label=py3_5.status)
joint_modeler = Python3Script(joint=py3_5.joint)  # -> out, joint, launch, spaceCount
# ---------- joint_modeler: Python ----------
launch = joint is not None
spaceCount = []
if(joint is not None):
    spaceCount = len(joint.spaces)
# ---------- end joint_modeler ----------
scroll_9 = UiScrollLayout(Elements=merge_50, Horizontal=0, Vertical=0)
merge_52 = Merge(Data1=scroll, Data2=scroll_7, Data3=scroll_5, Data4=scroll_8, Data5=scroll_9)
tab = UiTabbedLayout(Elements=merge_52, Names=panel_31)
scroll_10 = UiScrollLayout(Elements=tab, Horizontal=0, Vertical=0)
window_5 = UiWindow(Elements=scroll_10, Title="CM", Owner=2, Scroll=True, Launch=Toggle(True))
series_2 = Series(Start=1, Step=1, Count=joint_modeler.spaceCount)
py3_6 = Python3Script(host=simulation_ui_layout.host, view=get_values_74, act=get_values_75)  # -> out, stageCen, scale, axis, rotMag, transMag, refPt, edgeStart, edgeEnd; inputs view: list of Boolean, act: list of Double
# ---------- py3_6: Python ----------
import numpy as np
stageCen = host.parser.nodes
scale = host.parser.scale
axis, rotMag, transMag, refPt = host.simulator.simulate(view, act)
edgeStart = host.parser.edgeStart
edgeEnd = host.parser.edgeEnd
# ---------- end py3_6 ----------
refire_bus_8 = Python3Script(host=simulation_ui_layout.host, reset=get_values_73)  # -> locked, refire
# ---------- refire_bus_8: Python ----------
"""Grasshopper Script"""

import System
import Rhino
import Grasshopper

import rhinoscriptsyntax as rs


class MyComponent(Grasshopper.Kernel.GH_ScriptInstance):
    def RunScript(self, host, wait, reset):
        
        refire = any([
        reset,
        ])

        locked = host.refireLock
        refire = refire and not host.refireLock

        return host.refireLock, True if refire else []
# ---------- end refire_bus_8 ----------
format = Format(Format="View constraint space {0}", Culture=127, Data0=series_2)
panel_43 = Panel(refire_bus_8.locked)
spec_visualizer_3 = SpecVisualizer(
    stagecen=py3_6.stageCen,
    scale=py3_6.scale,
    axis=py3_6.axis,
    rotmag=py3_6.rotMag,
    transmag=py3_6.transMag,
    refpt=py3_6.refPt)  # -> stages_2, trajectory_2
button_51 = UiButton(Label="Reset")
check_box_10 = UiCheckBox(Label="View Hint", State=False)
button_52 = UiButton(Label="Add rod")
button_53 = UiButton(Label="Add blade")
check_box_11 = UiCheckBox(Label=format, State=False)
text_block_7 = UiTextBlock(Text="No text supplied")
merge_53 = Merge(Data1=button_52, Data2=button_53)
refire_trigger_12 = CSharpScript(tar=locator_7.id, trigger=refire_bus_8.refire, millis=Slider(1, range=0..100))  # inputs tar: Guid, trigger: Boolean, millis: Int32; same code as refire_trigger
stack_38 = UiStackLayout(Elements=merge_53, Horizontal=True)
item_6 = ListItem(List=py3_6.stageCen, Index=py3_6.edgeStart, Wrap=True)
item_7 = ListItem(List=py3_6.stageCen, Index=py3_6.edgeEnd, Wrap=True)
merge_54 = Merge(
    Data2=flatten(check_box_10),
    Data3=flatten(stack_38),
    Data4=flatten(button_51),
    Data5=flatten(check_box_11),
    Data6=flatten(text_block_7))
preview_17 = CustomPreview(Geometry=spec_visualizer_3.trajectory_2, Material=ColourSwatch(SwatchColor=RGB(120, 120, 120)))
preview_18 = CustomPreview(Geometry=spec_visualizer_3.stages_2, Material=ColourSwatch(SwatchColor=RGBA(236, 100, 43, 109)))
ln = Line(StartPoint=item_6, EndPoint=item_7)
window_6 = UiWindow(Elements=merge_54, Title="Ui+ Viewer", Owner=1, Scroll=True, Launch=joint_modeler.launch)
len = Length(Curve=ln)
eval = EvaluateCurve(Curve=reparameterize(ln), Parameter=0)  # -> Point, Tangent, Angle
eval_2 = EvaluateCurve(Curve=reparameterize(ln), Parameter=1)  # -> Point, Tangent, Angle
multiplication = Multiplication(A=len, B=0.25)
rev = Reverse(Vector=eval_2.Tangent)
amp = Amplitude(Vector=eval.Tangent, Amplitude=multiplication)
get_values_76 = UiValues(Element=button_51)
get_values_77 = UiValues(Element=button_52)
get_values_78 = UiValues(Element=button_53)
amp_2 = Amplitude(Vector=rev, Amplitude=multiplication)
panel_44 = Panel(get_values_76)
panel_45 = Panel(get_values_78)
panel_46 = Panel(get_values_77)
addition = Addition(A=amp, B=item_6)
addition_2 = Addition(A=amp_2, B=item_7)
py3_7 = Python3Script(joint=joint_modeler.joint, addRod=get_values_77, addBlade=get_values_78, reset=get_values_76)  # -> out, joint, message
# ---------- py3_7: Python ----------
if(addRod):
    joint.addRod()

if(addBlade):
    joint.addBlade()
    
if(reset):
    joint.reset()

message = ""
if(joint is not None): message = joint.message
# ---------- end py3_7 ----------
item_8 = ListItem(List=py3_6.rotMag, Index=py3_6.edgeStart, Wrap=True)
item_9 = ListItem(List=py3_6.refPt, Index=py3_6.edgeStart, Wrap=True)
item_10 = ListItem(List=py3_6.axis, Index=py3_6.edgeStart, Wrap=True)
item_11 = ListItem(List=py3_6.rotMag, Index=py3_6.edgeEnd, Wrap=True)
item_12 = ListItem(List=py3_6.refPt, Index=py3_6.edgeEnd, Wrap=True)
item_13 = ListItem(List=py3_6.axis, Index=py3_6.edgeEnd, Wrap=True)
rot3d = Rotate3D(Geometry=addition, Angle=item_8, Center=item_9, Axis=item_10)  # -> Geometry, Transform
rot3d_2 = Rotate3D(Geometry=addition, Angle=item_11, Center=item_12, Axis=item_13)  # -> Geometry, Transform
volume_2 = Volume(Geometry=spec_visualizer_3.stages_2)  # -> Volume, Centroid
rec_2 = DataRecorder(py3_7.out, DataLimit=-10, RecordData=True)
text_block_8 = UiTextBlock(Element=text_block_7, Text=py3_7.message)
vec2pt = Vector2Pt(PointA=item_6, PointB=rot3d.Geometry, Unitize=False)  # -> Vector, Length
vec2pt_2 = Vector2Pt(PointA=item_7, PointB=rot3d_2.Geometry, Unitize=False)  # -> Vector, Length
panel_47 = Panel(rec_2)
item_14 = ListItem(List=volume_2.Centroid, Index=py3_6.edgeStart, Wrap=True)
item_15 = ListItem(List=volume_2.Centroid, Index=py3_6.edgeEnd, Wrap=True)
axial_space = AxialSpace()  # -> axes, spaces, frame
bzspan = BezierSpan(StartPoint=item_14, StartTangent=vec2pt.Vector, EndPoint=item_15, EndTangent=vec2pt_2.Vector)  # -> Curve, Length, Domain
division = Division(A=py3_6.scale, B=20)
py3_8 = Python3Script(joint=py3_7.joint, refAxes=axial_space.axes, refSpaces=axial_space.spaces, refFrames=axial_space.frame)  # -> out, flexures, flexuresOC, dirGuide, posGuide, conSpace; inputs refAxes: tree, refSpaces: tree, refFrames: tree
# ---------- py3_8: Python ----------
__author__ = "MML"
__version__ = "2022.01.03"

import rhinoscriptsyntax as rs
from Grasshopper import DataTree
from Grasshopper.Kernel.Data import GH_Path as treePath
from Rhino.Geometry import GeometryBase

SCALE = 30
EPSILON = 1e-6

def unpackBases(bases):

    if(len(bases) == 0):
        return []

    if(not isinstance(bases[0], list)):
        return rs.AddPoint(bases)

    else:
        result = []
        for item in bases:
            result += [unpackBases(item)]
        return result

def unpackSpans(vecs):

    spanVecs = []
    if(len(vecs) == 0): return spanVecs

    for vec in vecs:
        if(len(vec) == 0): continue
        newVec = rs.AddPoint(vec)
        spanVecs += [newVec]

    return spanVecs

def findFrame(spanVecs, bases):

    principle = []

    for vec in spanVecs + bases:

        if(rs.VectorLength(vec) <= EPSILON): continue

        included = isVectorPresent(principle, vec)

        if(not included): principle += [vec]

        if(len(principle) >= 2):
            # shortcut, x y vectors found
            break

    assert len(principle) == 2

    return principle

def isVectorPresent(pool, vec):

    included = False

    for poolVec in pool:
        angle = rs.VectorAngle(poolVec, vec)
        if(angle <= EPSILON):
            included = True
            break

    return included

def view(motion, isFreedom=False, bases=None):
    moType, axis, refPt, spanVecs = motion
    moType = moType if isFreedom else 'c'
    isTrans = moType == 't'

    # convert
    axis = [rs.AddPoint(vec) for vec in axis]
    refPt = rs.AddPoint(refPt)
    spanVecs = unpackSpans(spanVecs)

    if(bases == None):
        bases = ((1, 0, 0), (0, 1, 0), (0, 0, 1))

    # create ordered list of reference frame vectors
    directors = axis + spanVecs
    xTar, yTar = findFrame(directors, bases)

    # create target frame using vectors
    targetFrame = rs.PlaneFromFrame(refPt, xTar, yTar)
    
    # find out which reference axial space to use
    if(not isTrans):
        axisDeg, spanDeg = len(axis), len(spanVecs)

    else:
        axisDeg, spanDeg = len(spanVecs), 0

    if(axisDeg == 1 and spanDeg == 1): # special case override
        axisDeg, spanDeg = 1, 0

    pathKey = treePath(axisDeg, spanDeg)
    axesToUse = refAxes.Branch(pathKey)
    spacesToUse = refSpaces.Branch(pathKey)
    frameToUse = refFrames.Branch(pathKey)[0]

    # orient reference axial space to target
    linesOriented = []
    axesOriented = []
    spacesOriented = []

    for line in axesToUse:
        lineOriented = frameOrient(line, frameToUse, targetFrame, flags=1)
        linesOriented += [lineOriented]

        for obj in addAxesObj(lineOriented, moType):
            axesOriented += [obj]

    for obj in spacesToUse:
        objOriented = frameOrient(obj, frameToUse, targetFrame, flags=1)
        spacesOriented += [objOriented]

    return linesOriented, axesOriented, spacesOriented

def frameOrient(obj, source, target, flags=0):

    sourcePts = [source[0], source[0] + source[1], source[0] + source[2]]
    targetPts = [target[0], target[0] + target[1], target[0] + target[2]]
    
    oriented = rs.OrientObject(obj, sourcePts, targetPts, flags=flags)

    return oriented

def addAxesObj(line, moType):

    if(moType == 'r'):
        shapes = drawRotAxis(line, drawArc=True)

    elif(moType == 't'):
        shapes = drawTransAxis(line)

    elif(moType == 'c'):
        shapes = drawRotAxis(line, drawArc = False)

    return shapes

def drawArrow(anchor, vec, addCone=True):

    scale = rs.VectorLength(vec) / SCALE
    height = 2 * scale
    dia = 1 * scale

    end = rs.VectorAdd(anchor, vec)
    pipe = rs.AddPipe(rs.AddLine(anchor, end), 0, dia / 4, cap=1)

    if(addCone):
        apex = rs.VectorAdd(end, rs.VectorScale(rs.VectorUnitize(vec), height))
        plane = rs.PlaneFromNormal(apex, -vec)
        cone = rs.AddCone(plane, height, dia)
        arrow = rs.BooleanUnion(pipe + [cone])
    else:
        arrow = pipe

    return arrow[0]

def drawRotAxis(line, drawArc=True):

    scale = rs.CurveLength(line) / SCALE / 2
    height = 2 * scale
    dia = 1 * scale
    arcDeg = 240
    rotation = (360 - arcDeg) / 2
    arcRad = 2 * scale

    start = rs.CurveStartPoint(line) 
    mid = rs.CurveMidPoint(line)
    end = rs.CurveEndPoint(line)
    vecMS = rs.PointSubtract(start, mid)
    vecME = rs.PointSubtract(end, mid)
    vec = rs.VectorUnitize(rs.VectorSubtract(end, start))

    axisPipe = [drawArrow(mid, vecMS, False), drawArrow(mid, vecME, False)]

    arcPlane = rs.RotatePlane(rs.PlaneFromNormal(start, vec), rotation, vec)
    arc = rs.AddArc(arcPlane, arcRad, arcDeg)
    arcPipe = rs.AddPipe(arc, 0, dia / 4, cap=1)
    arcDom = rs.CurveDomain(arc)
    tangStart = rs.CurveTangent(arc, arcDom[0])
    tangEnd   = rs.CurveTangent(arc, arcDom[1]) * -1
    arcStart = rs.CurveStartPoint(arc)
    arcEnd = rs.CurveEndPoint(arc)

    planeStart = rs.PlaneFromNormal(arcStart - tangStart, tangStart)
    planeEnd = rs.PlaneFromNormal(arcEnd - tangEnd, tangEnd)
    coneStart = rs.AddCone(planeStart, height, dia)
    coneEnd = rs.AddCone(planeEnd, height, dia)
    arcArrow = rs.BooleanUnion(arcPipe + [coneStart, coneEnd])

    if(drawArc): shape = arcArrow + axisPipe
    else: shape = axisPipe

    return shape

def drawTransAxis(line):

    start = rs.CurveStartPoint(line) 
    mid = rs.CurveMidPoint(line)
    end = rs.CurveEndPoint(line)
    vecMS = rs.PointSubtract(start, mid)
    vecME = rs.PointSubtract(end, mid)

    arrows = [drawArrow(mid, vecMS), drawArrow(mid, vecME)]

    return arrows

def drawModes(info, bases):

    linesT = DataTree[object]()
    spacesT = DataTree[object]()
    visT = DataTree[object]()

    # draw mode-freedom spaces
    for i in range(len(info)):
        for j in range(len(info[i])):
            space = info[i][j]
            lines, axes, spaces = view(space, True, bases[i])     

            path = treePath(i, j)
            linesT.AddRange(lines, path)
            visT.AddRange(axes, path)
            visT.AddRange(spaces, path)
            spacesT.AddRange(spaces, path)

    return linesT, spacesT, visT

def drawFlexures(joint):

    bases = unpackBases(joint.bases)
    # rods and overconstraints
    flexureT = DataTree[object]()
    flexureOCT = DataTree[object]()

    OCInfo = joint.OC
    for flexure in joint.flexures:
        geo = flexure.outputVis()

        if(flexure.id in OCInfo): flexureOCT.AddRange(geo)
        else: flexureT.AddRange(geo)

    # spaces
    linesT = DataTree[object]()
    spacesT = DataTree[object]()
    visT = DataTree[object]()

    conSpaceInfo = joint.spaces
    for i in range(len(conSpaceInfo)):
        space = conSpaceInfo[i]
        lines, axes, spaces = view(space, False, bases)

        path = treePath(i)
        linesT.AddRange(lines, path)
        visT.AddRange(axes, path)
        visT.AddRange(spaces, path)
        spacesT.AddRange(spaces, path)

    return flexureT, flexureOCT, linesT, spacesT, visT

if __name__ == "__main__":

    if(joint is not None):
        flexures, flexuresOC, dirGuide, posGuide, conSpace = drawFlexures(joint)
# ---------- end py3_8 ----------
swatch_2 = ColourSwatch(SwatchColor=RGB(120, 120, 120))
pipe_4 = Pipe(Curve=bzspan.Curve, Radius=division, Caps=2)
get_values_79 = UiValues(Element=check_box_11)
preview_19 = CustomPreview(Geometry=pipe_4, Material=ColourSwatch(SwatchColor=RGBA(236, 100, 43, 128)))
get_values_80 = UiValues(Element=check_box_10)
panel_48 = Panel(get_values_79)
panel_49 = Panel(get_values_80)
dispatch_5 = Dispatch(List=py3_8.conSpace, DispatchPattern=get_values_79)  # -> ListA, ListB
swatch_3 = ColourSwatch(SwatchColor=RGBA(236, 100, 43, 64))
dispatch_6 = Dispatch(List=py3_8.dirGuide, DispatchPattern=get_values_80)  # -> ListA, ListB
dispatch_7 = Dispatch(List=py3_8.posGuide, DispatchPattern=get_values_80)  # -> ListA, ListB
preview_20 = CustomPreview(Geometry=dispatch_5.ListA, Material=ColourSwatch(SwatchColor=RGBA(0, 0, 255, 64)))
preview_21 = CustomPreview(Geometry=dispatch_6.ListA, Material=swatch_3)
preview_22 = CustomPreview(Geometry=dispatch_7.ListA, Material=swatch_3)
preview_23 = CustomPreview(Geometry=py3_8.flexures, Material=ColourSwatch(SwatchColor=RGBA(0, 0, 0, 196)))
preview_24 = CustomPreview(Geometry=py3_8.flexuresOC, Material=ColourSwatch(SwatchColor=RGBA(255, 0, 255, 196)))
py3_9 = Python3Script(host=state_engine.host)  # -> out, host, countMsg, jointCount; disabled
# ---------- py3_9: Python ----------
def overviewMsg(host):
    modeCount = host.objectives.count
    jointCount = len(host.parser.edges)
    
    msg = "The design requires %d kineamtic modes and %d joints." % (modeCount, jointCount)

    return msg

if(host.solver.status["complete"]):
    countMsg = overviewMsg(host)
    jointCount = len(host.parser.edges)
# ---------- end py3_9 ----------
panel_50 = Panel("View constraint space")  # disabled
panel_51 = Panel("View hints")  # disabled
check_box_12 = UiCheckBox(Label=panel_51, State=False)  # disabled
check_box_13 = UiCheckBox(Label=panel_50, State=False)  # disabled
C = Count(py3_9.jointCount)  # disabled
panel_52 = Panel("Completed")  # disabled
panel_53 = Panel("Incomplete")  # disabled
panel_54 = Panel("Null")  # disabled
merge_55 = Merge(Data1=check_box_13, Data2=check_box_12)  # disabled
merge_56 = Merge(Data1=panel_52, Data2=panel_53, Data3=panel_54)  # disabled
panel_55 = Panel("Edit")  # disabled
panel_56 = Panel("Reset")  # disabled
stack_39 = UiStackLayout(Elements=merge_55, Horizontal=True)  # disabled
panel_57 = Panel("""No over-constraining flexures found. 
Add more flexures.
Both wire and blade flexures are viable.

No flexures added yet.

Any blade or rod that is parallel to the highlighted planes 
are valid flexures.

(x) Min. needed degrees of constraint 0/5
(x) unique constraint directions 0/2
(x) unique constraint positions 0/3""")  # disabled
series_3 = Series(Start=0, Step=1, Count=C)  # disabled
panel_58 = Panel("Delete flexure")  # disabled
panel_59 = Panel("Add wire flexure")  # disabled
panel_60 = Panel("Add blade flexure")  # disabled
panel_61 = Panel("""No over-constraining flexures found. 
Add more flexures.
Both wire and blade flexures are viable.

Try duplicating the flexure along parallel planes.

Any blade or rod that is parallel to the highlighted planes 
are valid flexures.

(x) Min. needed degrees of constraint 3/5
(x) unique constraint directions 2/2
(x) unique constraint positions 1/3""")  # disabled
panel_62 = Panel("Reset")  # disabled
repeat_9 = RepeatData(Data=graft(merge_56), Length=graft([2, 1, 14]))  # -> flatten(Data); disabled
panel_63 = Panel("This flexure group is required to enstate any configuration")  # disabled
repeat_10 = RepeatData(Data=panel_55, Length=C)  # -> flatten(Data); disabled
repeat_11 = RepeatData(Data=panel_56, Length=C)  # -> flatten(Data); disabled
panel_64 = Panel("Joint {0}")  # disabled
button_54 = UiButton(Label=panel_59)  # disabled
button_55 = UiButton(Label=panel_60)  # disabled
button_56 = UiButton(Label=panel_62)  # disabled
button_57 = UiButton(Label=panel_58)  # disabled
panel_65 = Panel("Generate Modeling Instructions")  # disabled
panel_66 = Panel("Reset")  # disabled
panel_67 = Panel("Set stage geometries")  # disabled
panel_68 = Panel("View flexure groups")  # disabled
button_58 = UiButton(Label=repeat_10)  # disabled
get_values_81 = UiValues(Element=button_58)  # -> flatten(Values); disabled
item_16 = ListItem(List=get_values_81, Index=2, Wrap=True)  # disabled
button_59 = UiButton(Label=repeat_11)  # disabled
label_10 = UiLabel(Label=repeat_9)  # disabled
format_2 = Format(Format=panel_64, Culture=127, Data0=series_3)  # disabled
panel_69 = Panel()  # disabled
label_11 = UiLabel(Label=panel_61)  # disabled
text_block_9 = UiTextBlock(Text=py3_9.countMsg)  # disabled
button_60 = UiButton(Label=panel_65)  # disabled
button_61 = UiButton(Label=panel_66)  # disabled
button_62 = UiButton(Label=panel_68)  # disabled
button_63 = UiButton(Label=panel_67)  # disabled
panel_70 = Panel()  # disabled
merge_57 = Merge(Data1=button_54, Data2=button_55)  # disabled
text_block_10 = UiTextBlock(Text=panel_63)  # disabled
split = SplitList(List=label_10, Index=C)  # -> flatten(ListA), ListB; disabled
merge_58 = Merge(Data1=button_57, Data2=button_56)  # disabled
label_12 = UiLabel(Label=format_2)  # -> flatten(Elements); disabled
merge_59 = Merge(Data1=graft(label_12), Data2=graft(button_58), Data3=graft(button_59), Data4=graft(split.ListA))  # disabled
scroll_11 = UiScrollLayout(Elements=label_11, Horizontal=1, Vertical=1)  # disabled
merge_60 = Merge(Data1=button_60, Data2=button_61)  # disabled
merge_61 = Merge(Data1=button_63, Data2=button_62)  # disabled
stack_40 = UiStackLayout(Elements=merge_57, Horizontal=True)  # disabled
stack_41 = UiStackLayout(Elements=merge_58, Horizontal=True)  # disabled
label_13 = UiLabel(Label=panel_69)  # disabled
stack_42 = UiStackLayout(Elements=merge_59, Horizontal=True)  # -> flatten(Element); disabled
stack_43 = UiStackLayout(Elements=merge_60, Horizontal=True)  # disabled
stack_44 = UiStackLayout(Elements=merge_61, Horizontal=True)  # disabled
label_14 = UiLabel(Label=panel_70)  # disabled
merge_62 = Merge(Data1=text_block_10, Data2=stack_39, Data3=stack_40, Data4=stack_41, Data5=scroll_11)  # disabled
panel_71 = Panel("The current joint requires passive flexures.")  # disabled
py3_10 = Python3Script(x=panel_57)  # -> out, a; disabled
# ---------- py3_10: Python ----------
class Temp(object):
    def __init__(self):

        self.msg = x
        self.srf = []
        self.edit = False

a = Temp()

if(y):
    a = Temp()
# ---------- end py3_10 ----------
py3_11 = Python3Script(x=py3_10.a, y=item_16)  # -> out, a, b; disabled
# ---------- py3_11: Python ----------
if(y):
    x.edit = True

a = x
b = x.edit
# ---------- end py3_11 ----------
panel_72 = Panel(" ")  # disabled
panel_73 = Panel(" ")  # disabled
panel_74 = Panel(" ")  # disabled
panel_75 = Panel("Passive flexures")  # disabled
panel_76 = Panel("Flexure group 2")  # disabled
panel_77 = Panel("Flexure group 0")  # disabled
merge_63 = Merge(Data1=stack_43, Data2=text_block_9, Data3=stack_44, Data4=stack_42)  # disabled
label_15 = UiLabel(Label=panel_72)  # disabled
label_16 = UiLabel(Label=panel_73)  # disabled
label_17 = UiLabel(Label=panel_74)  # disabled
stack_45 = UiStackLayout(Elements=merge_63, Horizontal=False)  # disabled
expander_7 = UiExpanderLayout(Elements=merge_62, Title=panel_75, Direction=0, Closed=True)  # disabled
expander_8 = UiExpanderLayout(Elements=label_14, Title=panel_76, Direction=0, Closed=True)  # disabled
expander_9 = UiExpanderLayout(Elements=label_13, Title=panel_77, Direction=0, Closed=True)  # disabled
text_block_11 = UiTextBlock(Text=panel_71)  # disabled
panel_78 = Panel("{'message': 'Showing needed constreaint space.\nNeed more flexural rods.\n(x) required unique wire axis directions: 0/3\n(x) required unique wire positions: 0/2\nConstraint subsapce 1:\nAny axis that aligns with the displayed direction and lies anywhere in space is an allowed rod axis.  Note: axes must not all lie on a same plane.\nConstraint subsapce 2:\nAny axis that is parallel to the plane(s) and lies on this plane is an allowed rod axis.  Note: the axes must not intersect at the same point.\nConstraint subsapce 3:\nAny axis that is parallel to the plane(s) and lies on this plane is an allowed rod axis.  Note: the axes must not intersect at the same point.\nConstraint subsapce 4:\nAny axis in 3D space and passes through this line at some point is an allowed rod axis. Note: axes must not all lie on the same plane. ', 'spaces': [('r', ((0.0, 0.0, 1.0),), (12.5, 37.5, 25.0), ((1.0, 0.0, 0.0), (0.0, 1.0, 0.0), (0.0, 0.0, 1.0))), ('r', ((1.0, 0.0, 0.0), (0.0, 0.0, 1.0)), (12.5, 25.000001, 25.0), ((1.0, 0.0, 0.0), (0.0, 0.0, 1.0))), ('r', ((0.0, 1.0, 0.0), (0.0, 0.0, 1.0)), (25.000022, 37.5, 25.0), ((0.0, 1.0, 0.0), (0.0, 0.0, 1.0))), ('r', ((1.0, 0.0, 0.0), (0.0, 1.0, 0.0), (0.0, 0.0, 1.0)), (25.000022, 25.000001, 25.0), ((0.0, 0.0, 1.0),))], 'bases': ((1.0, 0.0, 0.0), (0.0, 1.0, 0.0), (0.0, 0.0, 1.0)), 'center': [12.5, 37.5, 25.0], 'OC': ()}")  # disabled
merge_64 = Merge(Data1=label_15, Data2=expander_9)  # disabled
merge_65 = Merge(Data1=label_16, Data2=expander_8)  # disabled
merge_66 = Merge(Data1=label_17, Data2=expander_7)  # disabled
get_values_82 = UiValues(Element=button_55)  # disabled
stack_46 = UiStackLayout(Elements=merge_64, Horizontal=True)  # disabled
stack_47 = UiStackLayout(Elements=merge_65, Horizontal=True)  # disabled
stack_48 = UiStackLayout(Elements=merge_66, Horizontal=True)  # disabled
button_64 = Button()  # disabled
swatch_4 = ColourSwatch(SwatchColor=RGB(255, 0, 0))  # disabled
swatch_5 = ColourSwatch(SwatchColor=RGB(255, 207, 0))  # disabled
swatch_6 = ColourSwatch(SwatchColor=RGB(255, 0, 0))  # disabled
axial_space_2 = AxialSpace()  # -> axes, spaces, frame; disabled
merge_67 = Merge(Data1=text_block_11, Data2=stack_48, Data3=stack_46, Data4=stack_47)  # disabled
get_values_83 = UiValues(Element=check_box_13)  # disabled
graphics_4 = UiSetGraphics(Element=label_15, AccentColor=swatch_4)  # disabled
graphics_5 = UiSetGraphics(Element=label_17, AccentColor=swatch_5)  # disabled
py3_12 = Python3Script(x=py3_11.a, trigger=get_values_82, before=panel_57, after=panel_61)  # -> out, msg, srf; disabled
# ---------- py3_12: Python ----------
import rhinoscriptsyntax as rs

if(trigger):
    pt1 = rs.GetPoint("Select corner 1")
    
    pt2 = rs.GetPoint("Select corner 2")
    
    pt3 = rs.GetPoint("Select corner 3")
    
    pt4 = rs.GetPoint("Select corner 4")

    srf = rs.AddSrfPt([pt1, pt2, pt3, pt4])
    x.srf = [srf]
    x.msg = after

srf = x.srf
msg = x.msg
# ---------- end py3_12 ----------
py3_13 = Python3Script(x=button_64)  # -> out, a, b; disabled
# ---------- py3_13: Python ----------
import Rhino
import rhinoscriptsyntax as rs
import scriptcontext as sc
import Rhino.Geometry as rg
import System

def isCoplanar(pts, tolerance=1e-6):
    if len(pts) != 4:
        return False
    plane = rg.Plane(pts[0], pts[1], pts[2])
    return plane.DistanceTo(pts[3]) <= tolerance

def main():
    # Ask user for mode
    choice = rs.GetString("Select input type", "Surface", ["Surface", "Points"])
    
    if choice == "Surface":
        go = Rhino.Input.Custom.GetObject()
        go.SetCommandPrompt("Select a surface")
        go.GeometryFilter = Rhino.DocObjects.ObjectType.Surface
        go.SubObjectSelect = False
        if go.Get() != Rhino.Input.GetResult.Object:
            print("No surface selected.")
            return "Cancelled"
        surf_ref = go.Object(0)
        surf = surf_ref.Surface()
        
        # Get domain and evaluate corners
        udom = surf.Domain(0)
        vdom = surf.Domain(1)
        corners = [
            surf.PointAt(udom.T0, vdom.T0),
            surf.PointAt(udom.T1, vdom.T0),
            surf.PointAt(udom.T1, vdom.T1),
            surf.PointAt(udom.T0, vdom.T1)
        ]
        return "Coplanar" if isCoplanar(corners) else "Not coplanar"

    elif choice == "Points":
        gp = Rhino.Input.Custom.GetObject()
        gp.SetCommandPrompt("Select 4 points (one by one)")
        gp.GeometryFilter = Rhino.DocObjects.ObjectType.Point
        gp.EnablePreSelect(False, True)
        pts = []
        while len(pts) < 4:
            res = gp.Get()
            if res != Rhino.Input.GetResult.Object:
                print("Cancelled.")
                return "Cancelled"
            obj_ref = gp.Object(0)
            pt = obj_ref.Point().Location
            pts.append(pt)
        return "Coplanar" if isCoplanar(pts) else "Not coplanar"

    else:
        return "Invalid input type"

# Run it
a = main()
# ---------- end py3_13 ----------
graphics_6 = UiSetGraphics(Element=label_16, AccentColor=swatch_6)  # disabled
swatch_7 = ColourSwatch(SwatchColor=RGBA(0, 0, 255, 115))  # disabled
py3_14 = Python3Script(
    host=py3_9.host,
    info=panel_78,
    refAxes=axial_space_2.axes,
    refSpaces=axial_space_2.spaces,
    refFrames=axial_space_2.frame)  # -> out, flexures, flexuresOC, dirGuide, posGuide, conSpace; inputs refAxes: tree, refSpaces: tree, refFrames: tree; disabled
# ---------- py3_14: Python ----------
__author__ = "MML"
__version__ = "2022.01.03"

import rhinoscriptsyntax as rs
from Grasshopper import DataTree
from Grasshopper.Kernel.Data import GH_Path as treePath
from Rhino.Geometry import GeometryBase

SCALE = 30
EPSILON = 1e-6

def unpackBases(bases):

    if(len(bases) == 0):
        return []

    if(not isinstance(bases[0], tuple)):
        return rs.AddPoint(bases)

    else:
        result = []
        for item in bases:
            result += [unpackBases(item)]
        return result

def unpackSpans(vecs):

    spanVecs = []
    if(len(vecs) == 0): return spanVecs

    for vec in vecs:
        if(len(vec) == 0): continue
        newVec = rs.AddPoint(vec)
        spanVecs += [newVec]

    return spanVecs

def findFrame(spanVecs, bases):

    principle = []

    for vec in spanVecs + bases:

        if(rs.VectorLength(vec) <= EPSILON): continue

        included = isVectorPresent(principle, vec)

        if(not included): principle += [vec]

        if(len(principle) >= 2):
            # shortcut, x y vectors found
            break

    assert len(principle) == 2

    return principle

def isVectorPresent(pool, vec):

    included = False

    for poolVec in pool:
        angle = rs.VectorAngle(poolVec, vec)
        if(angle <= EPSILON):
            included = True
            break

    return included

def view(motion, isFreedom=False, bases=None):
    moType, axis, refPt, spanVecs = motion
    moType = moType if isFreedom else 'c'
    isTrans = moType == 't'

    # convert
    axis = [rs.AddPoint(vec) for vec in axis]
    refPt = rs.AddPoint(refPt)
    spanVecs = unpackSpans(spanVecs)

    if(bases == None):
        bases = ((1, 0, 0), (0, 1, 0), (0, 0, 1))

    # create ordered list of reference frame vectors
    directors = axis + spanVecs
    xTar, yTar = findFrame(directors, bases)

    # create target frame using vectors
    targetFrame = rs.PlaneFromFrame(refPt, xTar, yTar)

    # find out which reference axial space to use
    if(not isTrans):
        axisDeg, spanDeg = len(axis), len(spanVecs)

    else:
        axisDeg, spanDeg = len(spanVecs), 0

    if(axisDeg == 1 and spanDeg == 1): # special case override
        axisDeg, spanDeg = 1, 0

    pathKey = treePath(axisDeg, spanDeg)
    axesToUse = refAxes.Branch(pathKey)
    spacesToUse = refSpaces.Branch(pathKey)
    frameToUse = refFrames.Branch(pathKey)[0]

    # orient reference axial space to target
    linesOriented = []
    axesOriented = []
    spacesOriented = []

    for line in axesToUse:
        lineOriented = frameOrient(line, frameToUse, targetFrame, flags=1)
        linesOriented += [lineOriented]

        for obj in addAxesObj(lineOriented, moType):
            axesOriented += [obj]

    for obj in spacesToUse:
        objOriented = frameOrient(obj, frameToUse, targetFrame, flags=1)
        spacesOriented += [objOriented]

    return linesOriented, axesOriented, spacesOriented

def frameOrient(obj, source, target, flags=0):

    sourcePts = [source[0], source[0] + source[1], source[0] + source[2]]
    targetPts = [target[0], target[0] + target[1], target[0] + target[2]]

    oriented = rs.OrientObject(obj, sourcePts, targetPts, flags=flags)

    return oriented

def addAxesObj(line, moType):

    if(moType == 'r'):
        shapes = drawRotAxis(line, drawArc=True)

    elif(moType == 't'):
        shapes = drawTransAxis(line)

    elif(moType == 'c'):
        shapes = drawRotAxis(line, drawArc = False)

    return shapes

def drawArrow(anchor, vec, addCone=True):

    scale = rs.VectorLength(vec) / SCALE
    height = 2 * scale
    dia = 1 * scale

    end = rs.VectorAdd(anchor, vec)
    pipe = rs.AddPipe(rs.AddLine(anchor, end), 0, dia / 4, cap=1)

    if(addCone):
        apex = rs.VectorAdd(end, rs.VectorScale(rs.VectorUnitize(vec), height))
        plane = rs.PlaneFromNormal(apex, -vec)
        cone = rs.AddCone(plane, height, dia)
        arrow = rs.BooleanUnion(pipe + [cone])
    else:
        arrow = pipe

    return arrow[0]

def drawRotAxis(line, drawArc=True):

    scale = rs.CurveLength(line) / SCALE / 2
    height = 2 * scale
    dia = 1 * scale
    arcDeg = 240
    rotation = (360 - arcDeg) / 2
    arcRad = 2 * scale

    start = rs.CurveStartPoint(line) 
    mid = rs.CurveMidPoint(line)
    end = rs.CurveEndPoint(line)
    vecMS = rs.PointSubtract(start, mid)
    vecME = rs.PointSubtract(end, mid)
    vec = rs.VectorUnitize(rs.VectorSubtract(end, start))

    axisPipe = [drawArrow(mid, vecMS, False), drawArrow(mid, vecME, False)]

    arcPlane = rs.RotatePlane(rs.PlaneFromNormal(start, vec), rotation, vec)
    arc = rs.AddArc(arcPlane, arcRad, arcDeg)
    arcPipe = rs.AddPipe(arc, 0, dia / 4, cap=1)
    arcDom = rs.CurveDomain(arc)
    tangStart = rs.CurveTangent(arc, arcDom[0])
    tangEnd   = rs.CurveTangent(arc, arcDom[1]) * -1
    arcStart = rs.CurveStartPoint(arc)
    arcEnd = rs.CurveEndPoint(arc)

    planeStart = rs.PlaneFromNormal(arcStart - tangStart, tangStart)
    planeEnd = rs.PlaneFromNormal(arcEnd - tangEnd, tangEnd)
    coneStart = rs.AddCone(planeStart, height, dia)
    coneEnd = rs.AddCone(planeEnd, height, dia)
    arcArrow = rs.BooleanUnion(arcPipe + [coneStart, coneEnd])

    if(drawArc): shape = arcArrow + axisPipe
    else: shape = axisPipe

    return shape

def drawTransAxis(line):

    start = rs.CurveStartPoint(line) 
    mid = rs.CurveMidPoint(line)
    end = rs.CurveEndPoint(line)
    vecMS = rs.PointSubtract(start, mid)
    vecME = rs.PointSubtract(end, mid)

    arrows = [drawArrow(mid, vecMS), drawArrow(mid, vecME)]

    return arrows

def drawHighlightAxis(vec):

    if(dispCenter == None):
        center = rs.AddPoint(0, 0, 0)
    else:
        center = dispCenter

    ptStart = rs.PointAdd(center, rs.VectorScale(vec, SCALE))
    ptEnd = rs.PointAdd(center, rs.VectorScale(vec, -SCALE))
    line = rs.AddLine(ptStart, ptEnd)
    tube = rs.AddPipe(line, 0, .5, cap=1)

    return [line], tube

def drawTwins(cable, axes):

    cableLine = rs.AddLine(cable.start, cable.end)
    twins = [cableLine]

    for i in range(len(axes)):
        twins += rotateAboutAxis(twins, axes[i])

    original = twins.pop(0) # remove the original cable

    geo = []

    for line in twins:
        geo +=  rs.AddPipe(line, 0, cable.rad, cap=1)

    twins = [original] + twins

    return twins, geo

def rotateAboutAxis(objects, axis):

    if(dispCenter == None):
        center = rs.AddPoint(0, 0, 0)
    else:
        center = dispCenter

    result = rs.RotateObjects(objects, center, 180, axis, True)
    return result

def drawModes(info, bases):

    linesT = DataTree[object]()
    spacesT = DataTree[object]()
    visT = DataTree[object]()

    # draw mode-freedom spaces
    for i in range(len(info)):
        for j in range(len(info[i])):
            space = info[i][j]
            lines, axes, spaces = view(space, True, bases[i])     

            path = treePath(i, j)
            linesT.AddRange(lines, path)
            visT.AddRange(axes, path)
            visT.AddRange(spaces, path)
            spacesT.AddRange(spaces, path)

    return linesT, spacesT, visT

def drawFlexures(info):

    bases = unpackBases(info["bases"])

    # rods and overconstraints
    flexureT = DataTree[object]()
    flexureOCT = DataTree[object]()

    OCInfo = info["OC"]
    for flexure in host.modeler.flexures:
        geo = flexure.outputVis()

        if(flexure.id in OCInfo): flexureOCT.AddRange(geo)
        else: flexureT.AddRange(geo)

    # spaces
    linesT = DataTree[object]()
    spacesT = DataTree[object]()
    visT = DataTree[object]()

    conSpaceInfo = info["spaces"]
    for i in range(len(conSpaceInfo)):
        space = conSpaceInfo[i]
        lines, axes, spaces = view(space, False, bases)

        path = treePath(i)
        linesT.AddRange(lines, path)
        visT.AddRange(axes, path)
        visT.AddRange(spaces, path)
        spacesT.AddRange(spaces, path)

    return flexureT, flexureOCT, linesT, spacesT, visT

if __name__ == "__main__":
    info = eval(info)

    if(len(info) != 0):
        flexures, flexuresOC, dirGuide, posGuide, conSpace = drawFlexures(info)
# ---------- end py3_14 ----------
brep_3 = Brep([<brep referenced from the Rhino model> x2])  # disabled
rec_3 = DataRecorder(py3_13.out, DataLimit=-10, RecordData=True)  # disabled
panel_79 = Panel("Joint 2")  # disabled
dispatch_8 = Dispatch(List=brep_3, DispatchPattern=get_values_83)  # -> ListA, ListB; disabled
panel_80 = Panel(rec_3)  # disabled
panel_81 = Panel("""0
1
2
0
1
2
0
1
2""")  # disabled
window_7 = UiWindow(Elements=merge_67, Title=panel_79, Owner=1, Scroll=False, Launch=py3_11.b)  # disabled
panel_82 = Panel("""Flexure Group
Config 0
Config 1
Group 0
Enabled
Disabled
Group 1
Disabled
Enabled""")  # disabled
label_18 = UiLabel(Element=label_11, Label=py3_12.msg)  # disabled
preview_25 = CustomPreview(Geometry=dispatch_8.ListA, Material=swatch_7)  # disabled
panel_83 = Panel("""0
0
0
1
1
1
2
2
2""")  # disabled
axial_space_3 = AxialSpace()  # -> axes, spaces, frame; disabled
label_19 = UiLabel(Label=panel_82)  # disabled
file = ReadFile(PerLineParse=False)  # disabled
relay = Relay()  # disabled
panel_84 = Panel("""4
8""")  # disabled
grid = UiGridLayout(Elements=label_19, Columns=panel_81, Rows=panel_83)  # disabled
visualizer_2 = GhPythonScript(Code=file, DispCenter=relay, RefAxes=axial_space_3.axes, RefSpaces=axial_space_3.spaces, RefFrames=axial_space_3.frame)  # -> Out, Rods, Cables, CableTwins, Sensors, SensorTwins, Step1Vis, Step2OC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; disabled
swatch_8 = ColourSwatch(SwatchColor=RGBA(0, 255, 0, 64))  # disabled
item_17 = ListItem(List=label_19, Index=panel_84, Wrap=True)  # disabled
toggle = BooleanToggle(False)  # disabled
panel_85 = Panel("Configuration map")  # disabled
graphics_7 = UiSetGraphics(Element=item_17, AccentColor=swatch_8)  # disabled
window_8 = UiWindow(Elements=grid, Title=panel_85, Owner=1, Scroll=False, Launch=toggle)  # disabled

bias_unpack = Python3Script(helper=gate.Target3)  # -> out, labels, setBtn, clrBtn, twists
# ---------- bias_unpack: Python ----------
labels = []
count = []
setBtn = []
clrBtn = []
twists = []

if(helper):
    labels = helper.biasLabels
    count = len(helper.biasLabels)
    setBtn = ["Set"] * count
    clrBtn = ["Clear"] * count
    twists = helper.biases
# ---------- end bias_unpack ----------
label_20 = UiLabel(Label=bias_unpack.labels)  # -> graft(Elements)
button_65 = UiButton(Label=bias_unpack.setBtn)  # -> graft(Elements)
button_66 = UiButton(Label=bias_unpack.clrBtn)  # -> graft(Elements)
button_67 = UiButton(Label="Apply bias")

label_21 = UiLabel(Label=bias_unpack.twists)  # -> graft(Elements)

merge_68 = Merge(Data1=label_20, Data2=button_65, Data3=button_66, Data4=label_21)
stack_49 = UiStackLayout(Elements=merge_68, Horizontal=True)  # -> flatten(Element)
merge_69 = Merge(Data1=stack_49, Data2=button_67)
stack_50 = UiStackLayout(Elements=merge_69, Horizontal=False)

merge_70 = Merge(Data1=stack_10, Data2=stack_50, Data3=stack_8, Data4=stack_11)
scroll_12 = UiScrollLayout(Elements=merge_70, Horizontal=0, Vertical=0)
get_values_84 = UiValues(Element=button_67)
get_values_85 = UiValues(Element=button_65)  # -> flatten(Values)
get_values_86 = UiValues(Element=button_66)  # -> flatten(Values)
decouple_fixer_monitor = Python3Script(
    helper=gate.Target3,
    setBias=get_values_85,
    clearBias=get_values_86,
    manualApply=get_values_84,
    firstHeuristics=get_values_41,
    secondHeuristics=get_values_42,
    magnitude=get_values_43,
    semiAuto=get_values_44,
    autoComplete=get_values_45,
    cancel=get_values_46)  # -> out, refire, helper, constructor; inputs setBias: list, clearBias: list, manualApply: Boolean, firstHeuristics: Int32, secondHeuristics: Int32, magnitude: Double, semiAuto: Boolean, autoComplete: Boolean, cancel: Boolean
# ---------- decouple_fixer_monitor: Python ----------
refire = []
constructor = []

if(helper):

    if(any(setBias)): helper.setBias(setBias)
    if(any(clearBias)): helper.clearBias(clearBias)
    if(manualApply): refire = helper.manual(firstHeuristics, secondHeuristics, magnitude)
    if(semiAuto): refire = helper.semiAuto(firstHeuristics, secondHeuristics, magnitude)
    if(autoComplete): refire = helper.autoComplete()
    if(cancel): refire = helper.cancel()

    constructor = helper.constructor
    helper = [] if (isinstance(refire, bool) and refire) else helper
# ---------- end decouple_fixer_monitor ----------
py3_15 = Python3Script(helper=decouple_fixer_monitor.helper)  # -> out, twists
# ---------- py3_15: Python ----------
twists = []

if(helper):
    twists = helper.biases
# ---------- end py3_15 ----------
view_3 = Python3Script(helper=decouple_fixer_monitor.helper, viewHints=get_values_39, viewAssignment=get_values_40)  # -> out, nodes, nodeColors, edges, edgeColors, scale; same code as view
window_9 = UiWindow(
    Elements=scroll_12,
    Title=heuristics_window_control_4.title,
    Owner=2,
    Scroll=True,
    Launch=heuristics_window_control_4.windowOpen)
label_22 = UiLabel(Element=flatten(label_21), Label=py3_15.twists)
num_4 = Number(view_3.scale)
pipe_5 = Pipe(Curve=view_3.edges, Radius=expr("x*.1", view_3.scale), Caps=0)  # -> flatten(Pipe)
box_5 = CenterBox(Base=view_3.nodes, X=num_4, Y=num_4, Z=num_4)
refire_bus_9 = Python3Script(host=core_engine.host, iterate=decouple_fixer_monitor.refire)  # -> locked, refire; same code as refire_bus_2
preview_26 = CustomPreview(Geometry=box_5, Material=view_3.nodeColors)
preview_27 = CustomPreview(Geometry=pipe_5, Material=view_3.edgeColors)
panel_86 = Panel(refire_bus_9.locked)
refire_trigger_13 = CSharpScript(trigger=refire_bus_9.refire, millis=Slider(1, range=0..100))  # inputs tar: Guid, trigger: Boolean, millis: Int32; same code as refire_trigger
refire_trigger_14 = CSharpScript(trigger=refire_bus_9.refire, millis=Slider(1, range=0..100))  # inputs tar: Guid, trigger: Boolean, millis: Int32; same code as refire_trigger
bias_constructor_heaser = Python3Script(cons=decouple_fixer_monitor.constructor)  # -> out, cons, title, run, avaTwists, mag, cand
# ---------- bias_constructor_heaser: Python ----------
title = []
avaTwists = []
mag = []
cand = []
run = False

if(cons):
    title = cons.label
    avaTwists = [str(vec.tolist()) for vec in cons.avaTwists]
    mag = cons.mag
    cand = (cons.cand * cons.mag).tolist()
    run = True
# ---------- end bias_constructor_heaser ----------

label_23 = UiLabel(Label="Bias twist (unit)")
dropdown_list_3 = UiDropdownList(Values=bias_constructor_heaser.avaTwists, Index=0)
scroll_number_3 = UiScrollNumber(Label="Magnitude", Number=bias_constructor_heaser.mag, Wrap=False, Digits=3)
merge_71 = Merge(Data2=flatten(label_23), Data3=flatten(dropdown_list_3), Data4=flatten(scroll_number_3))
stack_51 = UiStackLayout(Elements=merge_71, Horizontal=True)

panel_87 = Panel("""Rot-X
Rot-Y
Rot-Z
Trans-X
Trans-Y
Trans-Z""")
label_24 = UiLabel(Label=panel_87)
scroll_number_4 = UiScrollNumber(Number=bias_constructor_heaser.cand, Wrap=False, Digits=3)
merge_72 = Merge(Data1=flatten(label_24), Data2=flatten(scroll_number_4))
grid_2 = UiGridLayout(Elements=merge_72, Columns=[0, 1, 2, 3, 4, 5, 0, 1, 2, 3, 4, 5], Rows=[0, 0, 0, 0, 0, 0, 1, 1, 1, 1, 1, 1])
align = UiAlign(Element=grid_2, Alignment=1)

get_values_87 = UiValues(Element=dropdown_list_3)
get_values_88 = UiValues(Element=scroll_number_3)
get_values_89 = UiValues(Element=scroll_number_4)  # -> flatten(Values)

button_68 = UiButton(Label="Assign")
button_69 = UiButton(Label="Cancel")

get_values_90 = UiValues(Element=button_68)
get_values_91 = UiValues(Element=button_69)
decouple = Python3Script(
    cons=bias_constructor_heaser.cons,
    mode=get_values_70,
    pickTwistId=get_values_87,
    pickMag=get_values_88,
    tarTwist=get_values_89,
    assign=get_values_90,
    cancel=get_values_91)  # -> out, refire, cons; inputs mode: list of Boolean, pickTwistId: Int32, pickMag: Double, tarTwist: list of Double, assign: Boolean, cancel: Boolean
# ---------- decouple: Python ----------
refire = []

if(cons):

    cons.update(mode, pickTwistId, pickMag, tarTwist)

    if(assign): refire = cons.assign()
    if(cancel): refire = cons.cancel()
# ---------- end decouple ----------
refire_bus_10 = Python3Script(host=core_engine.host, iterate=decouple.refire)  # -> locked, refire; same code as refire_bus_2
panel_88 = Panel(refire_bus_10.locked)
refire_trigger_15 = CSharpScript(tar=locator_4.id, trigger=refire_bus_10.refire, millis=Slider(1, range=0..100))  # inputs tar: Guid, trigger: Boolean, millis: Int32; same code as refire_trigger

check_box_14 = UiCheckBox(Label="Preview", State=False)
merge_73 = Merge(Data1=button_68, Data2=button_69, Data3=check_box_14)
stack_52 = UiStackLayout(Elements=merge_73, Horizontal=True)

merge_74 = Merge(Data1=item_4.Item, Data2=stack_51, Data3=item_4.Item1, Data4=align, Data5=stack_52)
dispatch_9 = Dispatch(List=merge_74, DispatchPattern=bias_constructor_heaser.run)  # -> ListA, ListB
stack_53 = UiStackLayout(Elements=dispatch_9.ListA, Horizontal=False)

get_values_92 = UiValues(Element=check_box_14)
window_10 = UiWindow(Elements=stack_53, Title=bias_constructor_heaser.title, Owner=2, Scroll=True, Launch=bias_constructor_heaser.run)
mode_preview_2 = Python3Script(cons=decouple.cons, preview=get_values_92)  # -> out, stageCen, scale, axis, rotMag, transMag, refPt; inputs preview: Boolean
# ---------- mode_preview_2: Python ----------
stageCen = []
axis = []
rotMag = []
transMag = []
refPt = []
scale = []

if(cons):
    if(preview): stageCen, axis, rotMag, transMag, refPt = cons.outputScrew()
    if(preview): scale = cons.helper.solver.host.parser.scale
# ---------- end mode_preview_2 ----------
spec_visualizer_4 = SpecVisualizer(
    stagecen=mode_preview_2.stageCen,
    scale=mode_preview_2.scale,
    axis=mode_preview_2.axis,
    rotmag=mode_preview_2.rotMag,
    transmag=mode_preview_2.transMag,
    refpt=mode_preview_2.refPt)  # -> stages_2, trajectory_2
preview_28 = CustomPreview(Geometry=spec_visualizer_4.stages_2, Material=ColourSwatch(SwatchColor=RGB(255, 187, 0)))

# ==== cluster Visualizer
show_node_box = ClusterInput()
host = ClusterInput()
show_node_pt = ClusterInput()
show_edge_pt = ClusterInput()
show_edge_line = ClusterInput()
show_node_tag = ClusterInput()
show_edge_tag = ClusterInput()
show_node_box_2 = Boolean(show_node_box)
host_2 = Data(host)
show_node_pt_2 = Boolean(show_node_pt)
show_edge_pt_2 = Boolean(show_edge_pt)
show_edge_line_2 = Boolean(show_edge_line)
show_node_tag_2 = Boolean(show_node_tag)
show_edge_tag_2 = Boolean(show_edge_tag)
prototype = Python3Script(host=host_2)  # -> out, parser, nodes, edges, edgePts, nodesId, edgesId, nodesInfo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
# ---------- prototype: Python ----------
if(host is not None):

    parser = host.parser
    
    nodes = parser.nodes
    edges = parser.edges
    edgePts = parser.edgePts
    edgeStart, edgeEnd = parser.edgeStart, parser.edgeEnd
    nodesId = parser.nodesId
    nodesInfo = parser.nodesInfo
    edgesId = parser.edgesId
    edgesInfo = parser.edgesInfo
    axis, rotMag, transMag, refPt = parser.axis, parser.rotMag, parser.transMag, parser.refPt
    isRigid = parser.isRigid
    scale = parser.scale
    ioIds = parser.ioIds
    fixedIds = parser.fixedIds
    jointScrew = parser.jointScrew
# ---------- end prototype ----------
view = ModelView(View=<geometry referenced from the Rhino model>)  # -> View, Title, Perspective, Location, Target, XExtents, YExtents, ZExtents
deplane = DeconstructPlane(Plane=view.Location)  # -> Origin, XAxis, YAxis, ZAxis

pl = PlaneNormal(Origin=prototype.nodes, ZAxis=deplane.ZAxis)
Z = UnitZ(Factor=-1)
align = AlignPlane(Plane=pl, Direction=Z)  # -> Plane, Angle
prot = RotatePlane(Plane=align.Plane, Angle=1.570796327)

pl_2 = PlaneNormal(Origin=prototype.edgePts, ZAxis=deplane.ZAxis)
Z_2 = UnitZ(Factor=-1)
align_2 = AlignPlane(Plane=pl_2, Direction=Z_2)  # -> Plane, Angle
prot_2 = RotatePlane(Plane=align_2.Plane, Angle=1.570796327)

box = CenterBox(Base=prototype.nodes, X=prototype.scale, Y=prototype.scale, Z=prototype.scale)
multiplication = Multiplication(A=prototype.scale, B=0.5)
as_text = AnnotationTextSettings(TextHeight=multiplication)  # -> TextSettings, Font, TextHeight, TextGap, MaskColour, MaskMargins, MaskFrame, ViewOriented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
text_entity = TextEntity(Plane=prot, Text=prototype.nodesId, TextSettings=as_text.TextSettings)
text_entity_2 = TextEntity(Plane=prot_2, Text=prototype.edgesId, TextSettings=as_text.TextSettings)
dispatch = Dispatch(List=prototype.nodes, DispatchPattern=show_node_pt_2)  # -> ListA, ListB
dispatch_2 = Dispatch(List=prototype.edgePts, DispatchPattern=show_edge_pt_2)  # -> ListA, ListB
dispatch_3 = Dispatch(List=box, DispatchPattern=show_node_box_2)  # -> ListA, ListB
dispatch_4 = Dispatch(List=prototype.edges, DispatchPattern=show_edge_line_2)  # -> ListA, ListB
dispatch_5 = Dispatch(List=text_entity, DispatchPattern=show_node_tag_2)  # -> ListA, ListB
dispatch_6 = Dispatch(List=text_entity_2, DispatchPattern=show_edge_tag_2)  # -> ListA, ListB
node_box = Box(dispatch_3.ListA)
edge_line = Line(dispatch_4.ListA)
text_entity_3 = TextEntity(dispatch_5.ListA)
text_entity_4 = TextEntity(dispatch_6.ListA)
node_pts = Point(dispatch.ListA)
edge_pts = Point(dispatch_2.ListA)
edge_line_2 = ClusterOutput(edge_line)
node_pts_2 = ClusterOutput(node_pts)
edge_pts_2 = ClusterOutput(edge_pts)
node_box_2 = ClusterOutput(node_box)
text_entity_5 = ClusterOutput(text_entity_3)
text_entity_6 = ClusterOutput(text_entity_4)

# ==== cluster SpecVisualizer
stagecen = ClusterInput()
scale = ClusterInput()
axis = ClusterInput()
rotmag = ClusterInput()
transmag = ClusterInput()
refpt = ClusterInput()
ex = ClusterInput()
ex_2 = Number(ex)
stagecen_2 = Point(stagecen)
scale_2 = Number(scale)
axis_2 = Vector(axis)
rotmag_2 = Number(rotmag)
transmag_2 = Number(transmag)
refpt_2 = Point(refpt)
multiplication = Multiplication(A=rotmag_2, B=ex_2)
multiplication_2 = Multiplication(A=transmag_2, B=ex_2)
num = Number(scale_2)
range = Range(Domain=multiplication, Steps=10)
range_2 = Range(Domain=multiplication_2, Steps=10)
box = CenterBox(Base=stagecen_2, X=num, Y=num, Z=num)
rot3d = Rotate3D(Geometry=graft(stagecen_2), Angle=range, Center=graft(refpt_2), Axis=graft(axis_2))  # -> Geometry, Transform
amp = Amplitude(Vector=graft(axis_2), Amplitude=range_2)
amp_2 = Amplitude(Vector=axis_2, Amplitude=multiplication_2)
rot3d_2 = Rotate3D(Geometry=box, Angle=multiplication, Center=refpt_2, Axis=axis_2)  # -> Geometry, Transform
move = Move(Geometry=rot3d_2.Geometry, Motion=amp_2)  # -> Geometry, Transform
move_2 = Move(Geometry=rot3d.Geometry, Motion=amp)  # -> Geometry, Transform
intcrv = Interpolate(Vertices=move_2.Geometry, Degree=3, Periodic=False, KnotStyle=1)  # -> Curve, Length, Domain
stages = Brep(move.Geometry)
trajectory = Curve(intcrv.Curve)
stages_2 = ClusterOutput(stages)
trajectory_2 = ClusterOutput(trajectory)

# ==== cluster AxialSpace
number_slider = Slider(108, range=0..1000)
pt = Point(Point(-149, -228, 0))
arrows = Curve([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])
blades = Surface([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])
line = Curve([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])
point = Point([Point(-95, -282, 0), Point(13, -282, 0), Point(121, -282, 0)])
plane = Surface([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])
box = Brep(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)
neg = Negative(Value=number_slider)
box_2 = Box(box)
series = Series(Start=0, Step=number_slider, Count=3)
series_2 = Series(Start=0, Step=neg, Count=4)
X = UnitX(Factor=series)
python = GhPythonScript(arrows=arrows, blades=blades, points=point, lines=line, planes=plane, boxes=box_2)  # -> out, axes, shapes; inputs arrows: list, blades: list, points: list, lines: list, planes: list, boxes: list
# ---------- python: Python ----------
__author__ = "MorphingMatterLab"
__version__ = "2020.08.16"

import rhinoscriptsyntax as rs
from Grasshopper import DataTree
from Grasshopper.Kernel.Data import GH_Path as treePath
from Rhino.Geometry import GeometryBase

SCALE = 20
EPSILON = 1e-6
colorCode = {'r':0, 't':1, 'c':2}

class ViewContainer(object):
    def __init__(self):
        self.axes = []
        self.spaces = []
        self.axesLines = []
    
    def addAxes(self, obj):
        self.axes += [obj]
    
    def addSpaces(self, obj):
        self.spaces += [obj]
    
    def addLine(self, obj):
        self.axesLines += [obj]

vc = ViewContainer()

def drawArrow(anchor, vec):
    
    height = 2
    dia = 1
    
    end = rs.VectorAdd(anchor, vec)
    pipe = rs.AddPipe(rs.AddLine(anchor, end), 0, dia / 4, cap=1)
    apex = rs.VectorAdd(end, rs.VectorScale(rs.VectorUnitize(vec), height))
    plane = rs.PlaneFromNormal(apex, -vec)
    
    cone = rs.AddCone(plane, height, dia)
    arrow = rs.BooleanUnion(pipe + [cone])
    
    return arrow[0]

def drawRotAxis(line):
    
    height = 2
    dia = 1
    arcDeg = 240
    rotation = (360 - arcDeg) / 2
    arcRad = 4
    
    start = rs.CurveStartPoint(line) 
    mid = rs.CurveMidPoint(line)
    end = rs.CurveEndPoint(line)
    vec = rs.VectorUnitize(rs.VectorSubtract(end, start))
    
    axisPipe = rs.AddPipe(line, 0, dia / 4, cap=2)
    arcPlane = rs.RotatePlane(rs.PlaneFromNormal(mid, vec), rotation, vec)
    arc = rs.AddArc(arcPlane, arcRad, arcDeg)
    arcPipe = rs.AddPipe(arc, 0, dia / 4, cap=1)
    
    arcDom = rs.CurveDomain(arc)
    tangStart = rs.CurveTangent(arc, arcDom[0])
    tangEnd   = rs.CurveTangent(arc, arcDom[1]) * -1
    arcStart = rs.CurveStartPoint(arc)
    arcEnd = rs.CurveEndPoint(arc)
    
    planeStart = rs.PlaneFromNormal(arcStart - tangStart, tangStart)
    planeEnd = rs.PlaneFromNormal(arcEnd - tangEnd, tangEnd)
    coneStart = rs.AddCone(planeStart, height, dia)
    coneEnd = rs.AddCone(planeEnd, height, dia)
    arcArrow = rs.BooleanUnion(arcPipe + [coneStart, coneEnd])
    
    return arcArrow + axisPipe

def drawPointSpace(refPt, spanVecs):
    
    return rs.AddPoint(refPt)

def drawLineSpace(refPt, spanVecs):
    
    span0 = spanVecs[0]
    pt0 = rs.VectorAdd(refPt, rs.VectorScale(span0, SCALE))
    pt1 = rs.VectorAdd(refPt, rs.VectorScale(span0, -SCALE))
    shape = rs.AddLine(pt0, pt1)
    
    return shape

def drawPlaneSpace(refPt, spanVecs):
    
    span0, span1 = spanVecs
    vec0 = rs.VectorAdd(rs.VectorScale(span0, -SCALE), rs.VectorScale(span1, -SCALE))
    vec1 = rs.VectorAdd(rs.VectorScale(span0, -SCALE), rs.VectorScale(span1, SCALE))
    vec2 = rs.VectorAdd(rs.VectorScale(span0, SCALE), rs.VectorScale(span1, SCALE))
    vec3 = rs.VectorAdd(rs.VectorScale(span0, SCALE), rs.VectorScale(span1, -SCALE))
    pt0 = rs.PointAdd(refPt, vec0)
    pt1 = rs.PointAdd(refPt, vec1)
    pt2 = rs.PointAdd(refPt, vec2)
    pt3 = rs.PointAdd(refPt, vec3)
    shape = rs.AddSrfPt([pt0, pt1, pt2, pt3])
    
    return shape

def drawBoxSpace(refPt, spanVecs):
    
    span0, span1, span2 = spanVecs
    vec0 = rs.VectorAdd(rs.VectorScale(span0, -SCALE), rs.VectorScale(span1, -SCALE))
    vec1 = rs.VectorAdd(rs.VectorScale(span0, -SCALE), rs.VectorScale(span1, SCALE))
    vec2 = rs.VectorAdd(rs.VectorScale(span0, SCALE), rs.VectorScale(span1, SCALE))
    vec3 = rs.VectorAdd(rs.VectorScale(span0, SCALE), rs.VectorScale(span1, -SCALE))
    pt0 = rs.PointAdd(refPt, vec0)
    pt1 = rs.PointAdd(refPt, vec1)
    pt2 = rs.PointAdd(refPt, vec2)
    pt3 = rs.PointAdd(refPt, vec3)
    
    pts = []
    for i in [-1, 1]:
        pts += rs.CopyObjects([pt0, pt1, pt2, pt3], rs.VectorScale(span2, i * SCALE))
    shape = rs.AddBox(pts)
    
    return shape

def drawLine(refPt, vec):
    
    vecScaled = rs.VectorScale(rs.VectorUnitize(vec), SCALE)
    refPt0 = rs.VectorSubtract(refPt, vecScaled)
    refPt1 = rs.VectorAdd(refPt, vecScaled)
    line = rs.AddLine(refPt0, refPt1)
    
    return line

def unpackSpans(vecs):
    
    spanVecs = []
    
    if(len(vecs) == 0): return spanVecs
    for vec in vecs:
        if(len(vec) == 0): continue
        newVec = rs.AddPoint(vec)
        spanVecs += [newVec]
    
    return spanVecs

def view(motion):
    moType, axis, refPt, spanVecs = motion
    
    # convert
    axis = [rs.AddPoint(vec) for vec in axis]
    refPt = rs.AddPoint(refPt)
    if(shift):
        refPt = rs.PointAdd(refPt, shift)
    spanVecs = unpackSpans(spanVecs)
    
    isTrans = moType == 't'
    color = colorCode[moType] if isFreedom else colorCode['c']
    viewObjs = []
    
    # axis view
    axisToDisp = spanVecs if isTrans else axis
    for vec in axisToDisp:
        # draw line
        vc.addLine(drawLine(refPt, vec))
        # draw axis element
        if(isTrans): # translation arrow
            for dir in [1, -1]:
                v = rs.VectorScale(rs.AddPoint(vec), dir * SCALE)
                arrow = drawArrow(refPt, v)
                vc.addAxes((arrow, color))
        if(not isTrans): # rotation axis
            line = rs.AddLine(rs.PointAdd(refPt, rs.VectorScale(vec,  SCALE)),
                              rs.PointAdd(refPt, rs.VectorScale(vec, -SCALE)))
            shapes = drawRotAxis(line)
            for shape in shapes: vc.addAxes((shape, color))
    
    # span view
    spanDeg = len(spanVecs)
    if(spanDeg == 0): # point
        pt = viewPt if isTrans else refPt
        shape = drawPointSpace(pt, spanVecs)
    elif(spanDeg == 1):
        shape = drawLineSpace(refPt, spanVecs)
    elif(spanDeg == 2):
        shape = drawPlaneSpace(refPt, spanVecs)
    elif(spanDeg == 3):
        shape = drawBoxSpace(refPt, spanVecs)
    else:
        assert False
    vc.addSpaces((shape, color))

def twoSidedArrow(line):
    
    midPt = rs.CurveMidPoint(line)
    vec = rs.PointSubtract(rs.CurveEndPoint(line), midPt)
    vecNeg = rs.VectorReverse(vec)
    
    return [drawArrow(midPt, vec)] + [drawArrow(midPt, vecNeg)]

axes = []
shapes = []

for line in arrows:
    axes += twoSidedArrow(line)
axes += blades
for pt in points:
    shapes += [rs.AddSphere(pt, 2)]
for line in lines:
    shapes += rs.AddPipe(line, 0, .25)
shapes += planes + boxes
# ---------- end python ----------
series_3 = Series(Start=pt, Step=1, Count=10)
Y = UnitY(Factor=series_2)
move = Move(Geometry=pt, Motion=X)  # -> graft(Geometry), Transform
midpt = CurveMiddle(Curve=arrows)
area = Area(Geometry=python.shapes)  # -> Area, Centroid
move_2 = Move(Geometry=move.Geometry, Motion=Y)  # -> simplify(graft(Geometry)), Transform
pdecon = Deconstruct(Point=midpt)  # -> XComponent, YComponent, ZComponent
pdecon_2 = Deconstruct(Point=area.Centroid)  # -> XComponent, YComponent, ZComponent
pt_2 = ConstructPoint(XCoordinate=pdecon.XComponent, YCoordinate=pdecon.YComponent, ZCoordinate=0)
pt_3 = ConstructPoint(XCoordinate=pdecon_2.XComponent, YCoordinate=pdecon_2.YComponent, ZCoordinate=0)
rectangle = Rectangle(Plane=move_2.Geometry, XSize=number_slider, YSize=neg, Radius=0)  # -> Rectangle, Length
path_mapper = PathMapper(rectangle.Rectangle, source="{A;B}", target="{A+1;B}")
incurve = PointInCurve(Point=pt_2, Curve=path_mapper)  # -> Relationship, Point
incurve_2 = PointInCurve(Point=pt_3, Curve=path_mapper)  # -> Relationship, Point
pcen = PolygonCenter(Polyline=path_mapper)  # -> CenterV, CenterE, CenterA
dispatch = Dispatch(List=arrows, DispatchPattern=incurve.Relationship)  # -> ListA, ListB
Y_2 = UnitY(Factor=1)
X_2 = UnitX(Factor=-1)
dispatch_2 = Dispatch(List=python.shapes, DispatchPattern=incurve_2.Relationship)  # -> ListA, ListB
pl = ConstructPlane(Origin=pcen.CenterV, XAxis=Y_2, YAxis=X_2)
spaces = ClusterOutput(dispatch_2.ListA)
frame = ClusterOutput(pl)
axes = ClusterOutput(dispatch.ListA)
